# Grasshopper definition 200624_semiramis_external_loop_control.gh (Grasshopper 1.0.7)

# Mode
# Set Geometry Input Mode
list = ValueList({"Generate from scratch": 0, "Generate from ML prediction": 1, "Generate from curves": 2}, selected="Generate from ML prediction")
automatic_control = BooleanToggle(True)

timer = Timer(TimerInterval=1, Target=generator)  # disabled
reset = Button()
# Generation counter
run = BooleanToggle(False)

generation_number = Integer(63)
generator_mode = Data(1)
include_invalid = BooleanToggle(True)
list_2 = ValueList({"xyz_pts": 0, "cpts_rrs": 1, "xyz_pts+cpts_rrs": 2}, selected="xyz_pts+cpts_rrs")
panel = Panel(generation_number)
generator = PythonScript(Run=run, Reset=reset)  # -> g, t; inputs Run: Boolean, Reset: Boolean
# ---------- generator: Python ----------
import time


"""
if it doesn't run (= static): g = 0 --> reset g  to 0
if it runs: g starts at 0
if reset: g starts from 0 again
"""


#set default at start only
if 'counter' not in globals():
    counter = -1 

#reset & idle
if Reset or not Run:
    counter = -1

if Run:
    counter += 1 
    t = time.ctime()




g = 0 if counter < 0 else counter # "stop" and counter=0 will both render =0
# ---------- end generator ----------
panel_2 = Panel(list)
# legend:: Generare from scratch       = 0
# Generate from ML prediction = 1
# Generate from curves        = 2
panel_3 = Panel(generator_mode)

manual_seed = Slider(5, range=0..100)
list_3 = ValueList({"no seed": 0, "seed from generation": 1, "manual seed": 2}, selected="seed from generation")

panel_4 = Panel(generator.g)
controller = GhPythonScript(control=automatic_control, manual_val=panel_2, automatic_val=panel_3)  # -> out, val; inputs manual_val: Int32, automatic_val: Int32
# ---------- controller: Python ----------
__author__ = "aapolina"
__version__ = "2020.06.24"


if control == True:
    val = automatic_val
elif control == False:
    val = manual_val
# ---------- end controller ----------
controller_2 = GhPythonScript(control=automatic_control, manual_val=panel_4, automatic_val=panel)  # -> out, val; inputs manual_val: Int32, automatic_val: Int32; same code as controller
panel_5 = Panel(controller.val)
panel_6 = Panel(controller_2.val)
# Recreate curves from ML
data_from_ml = Data("Grasshopper.Kernel.Types.GH_ObjectWrapper")
# Create geometry
set_multiple_curves = Curve([<curve referenced from the Rhino model> x7])  # disabled
data_format = ValueList({"xyz", "cpt_rrs": "cpt+rrs"}, selected="cpt_rrs")
python = GhPythonScript(data=data_from_ml)  # -> out, generation, geo
# ---------- python: Python ----------
__author__ = "aapolina"
__version__ = "2020.06.24"




generation = data['info']['generation']
geo = [data['geo']]
# ---------- end python ----------
panel_7 = Panel(python.generation)
G = GhPythonScript(mode=panel_5, g_from_gen_mode=controller_2.val, g_from_regen_mode=panel_7)  # -> out, g; inputs mode: Int32, g_from_gen_mode: Int32, g_from_regen_mode: Int32
# ---------- G: Python ----------
__author__ = "aapolina"
__version__ = "2020.06.24"

"""
Generare from scratch       = 0
Generate from ML prediction = 1
Generate from curves        = 2
"""

if mode == 0:
    g = g_from_gen_mode
elif mode == 1:
    g = g_from_regen_mode
else:
    g = -1
# ---------- end G ----------
generation = Panel(G.g)
int = Integer(generation)
# Data output
generation_2 = Panel(int)
seed = GhPythonScript(s=manual_seed, g=int, seed_option=list_3)  # -> rand_seed; inputs s: Int32
# ---------- seed: Python ----------
import Rhino.Geometry as rg
import ghpythonlib.components as ghcomp

if   seed_option == 0: rand_seed = None
elif seed_option ==1:  rand_seed = g
elif seed_option ==2:  rand_seed = s
# ---------- end seed ----------
seed_2 = Integer(seed)
panel_8 = Panel(seed_2)

# ----
# Build shape primitive (circle)
number_of_circle_points = Slider(8, range=2..15)
# Generate curves
x_origin = Slider(1.3, range=-10..10)
y_origin = Slider(0.315, range=-1..1)
radius_m = Slider(3, range=2..8)
number_of_circles = Slider(5, range=2..15)
lowest_curve_m = Slider(4.5, range=0..20)
total_height_m = Slider(19, range=6..24)
min_distance_m2 = Slider(3, range=1.5..3)
z_distribution = ValueList({"equal": 0, "random": 1, "random with min. dist.": 2}, selected="random with min. dist.")
simple_circles = GhPythonScript(
    x_origin=x_origin,
    y_origin=y_origin,
    radius=radius_m,
    n=number_of_circles,
    z_min=lowest_curve_m,
    z_max=total_height_m,
    d_min=min_distance_m2,
    z_option=z_distribution,
    rand_seed=seed_2,
    refresh=Button())  # -> out, circles, z, d; inputs n: Int32, z_option: Int32, rand_seed: Int32
# ---------- simple_circles: Python ----------
__author__ = "aapolina"
__version__ = "2020.03.26"

import Rhino.Geometry as rg
import random
import math

if rand_seed <> None: random.seed(rand_seed)
#refresh has an effect only if rand_seed = None

if z_option == 0:
    #equal
    z = [z_min + (z_max-z_min)/(n-1)*i for i in range(n)]
elif z_option == 1:
    #random
    rz = [0.0]+[random.random() for i in range(n-2)]+[1.0]
    rz.sort()
    z = [z_min + i*(z_max-z_min) for i in rz ]
elif z_option == 2:
    #random with min dist
    rd = [random.random() for i in range(n-1)] #random distances
    x = (z_max-z_min-d_min*(n-1)) / sum(rd)
    d = [d_min + ri*x for ri in rd]
    z = [z_min] + [z_min + sum(d[:i+1]) for i in range(n-1)]

d = [z[i+1]-z[i] for i in range(n-1)]

circles = [rg.Circle(rg.Point3d(x_origin,y_origin,zi), radius) for zi in z]
# ---------- end simple_circles ----------
distances_between_levels = Panel(simple_circles.d)
levels = Panel(simple_circles.z)
circles = Geometry(simplify(flatten(simple_circles.circles)))

# ----
# Support grid
# drive-through:
# max. width truck 2.6m
# max. height truck 4m
grid_size_m = Slider(3.4, range=1.5..6)
# Columns / Grid
x_shift_m = Slider(-0.55, range=-5..5)
y_shift_m = Slider(-0.29, range=-5..5)
angle = Slider(-11.9, range=-90..90)
origin = ValueList({"0,0,0": 0, "by point": 1, "by shift": 2}, selected="by shift")
list_4 = ValueList({"rectangular": 0, "triangular": 1}, selected="triangular")
manual_input_origin_pt = Point(Point(1, 1, 0))
origin_2 = GhPythonScript(pt=manual_input_origin_pt, dx=x_shift_m, dy=y_shift_m, option=origin)  # -> out, origin_pt; inputs pt: Point3d, option: Int32
# ---------- origin_2: Python ----------
__author__ = "aapolina"
__version__ = "2020.03.27"

import Rhino.Geometry as rg
default = rg.Point3d(0,0,0)

if option == 0:
    origin_pt = rg.Point3d(0,0,0)
elif option == 1:
    origin_pt = pt
elif option == 2:
    origin_pt = default + rg.Vector3d(dx,dy,0)
else:
    origin_pt = default
# ---------- end origin_2 ----------
grid = GhPythonScript(grid_size=grid_size_m, origin=origin_2.origin_pt, rotation=angle, size=radius_m, option=list_4)  # -> out, pts; inputs origin: Point3d, option: Int32
# ---------- grid: Python ----------
__author__ = "aapolina"
__version__ = "2020.03.27"

import Rhino.Geometry as rg
import math


"""
grid size: distance between points [m]
size: input diameter of the chalices to calc approx. span of the grid [m]
rotation: in degrees
"""

span = size*3.0 #in one direction, i.e. total span is double

pts = []

if option == 0:
    # rectangular
    n = int(math.ceil(span/grid_size))
    d = [i*grid_size for i in range(-n,n+1)]
    pts = [rg.Point3d(x,y,0) for x in d for y in d]

elif option == 1:
    # triangular
    h = grid_size*math.sqrt(3.0)*0.5
    nx = int(math.ceil(span/grid_size))
    ny = int(math.ceil(span/h))
    dx = [i*grid_size for i in range(-nx,nx+1)]
    dy = [i*h for i in range(-ny,ny+1)]
    pts = [rg.Point3d(x+grid_size*0.5*(i%2),y,0) for x in dx for i,y in enumerate(dy)]

#move origin:
pts = [p+origin for p in pts]

#rotate around origin:
xform = rg.Transform.Rotation(math.radians(rotation),origin)
for p in pts:  p.Transform(xform)
# ---------- end grid ----------
support_points_grid = Point(grid.pts)

python_2 = GhPythonScript(geo=python.geo, codec=data_format)  # -> out, pts
# ---------- python_2: Python ----------
__author__ = "aapolina"
__version__ = "2020.06.17"
import Rhino.Geometry as rg
import math


if codec == 'xyz':
    data = geo['xyz']
    pts = [[rg.Point3d(level[i*3+0],level[i*3+1],level[i*3+2]) for i in range(len(level)//3)] for level in data ]

elif codec == 'cpt+rrs':
    data = geo['cpts_rrs']
    pts = []
    k = len(data[0][1])#sample how many rr values
    rays =  [ rg.Vector3d(math.cos(alpha), math.sin(alpha), 0) for alpha in [math.pi*2*j/float(k) for j in range(k)]]
    
    for ci,rri in data:
        cpt = rg.Point3d(*ci)
        ptsi = [cpt + rays[j]*rri[j] for j in range(k)]
        pts.append(ptsi)
# ---------- end python_2 ----------
get_geometry = GhPythonScript(pts=python_2.pts)  # -> out, simplify(pts), simplify(pts_levelled), z_mean, z_variance; inputs pts: list
# ---------- get_geometry: Python ----------
__author__ = "aapolina"
__version__ = "2020.06.12"

import copy
from ghpythonlib.treehelpers import list_to_tree
import Rhino.Geometry as rg




pts_levelled = copy.deepcopy(pts)

z_mean = []
z_variance = []

for level in pts_levelled:
    n = len(level)
    
    zl_mean = sum([p.Z for p in level])/n
    z_mean.append(zl_mean)
    
    zl_var = sum([(zl_mean - p.Z)**2 for p in level])
    z_variance.append(zl_var)
    
    for p in level:
        p.Z = zl_mean

#////list to tree for output//////////////////////////////////
pts = list_to_tree(pts,[0])
pts_levelled = list_to_tree(pts_levelled,[0])
# ---------- end get_geometry ----------
mean_z_coordinate_per_level = Panel(get_geometry.z_mean)
z_coordinate_variance_per_level = Panel(get_geometry.z_variance)
curve_pts_to_interpolate = Point(get_geometry.pts_levelled)
tangential_distortion_100 = Slider(0, range=0..1)
# Randomize form
distortion_m = Slider(1.5, range=0..2)
shift_random_m = Slider(3, range=0..5)
intcrv = Interpolate(Vertices=curve_pts_to_interpolate, Degree=3, Periodic=True, KnotStyle=0)  # -> Curve, Length, Domain
randomize_form = GhPythonScript(
    circles=circles,
    u=number_of_circle_points,
    distortion_abs=distortion_m,
    distortion_tan=tangential_distortion_100,
    shift_abs=shift_random_m,
    rand_seed=seed_2)  # -> out, flatten(curves), test, simplify(all_pts), simplify(all_cpts), simplify(all_rrs), simplify(all_trs); inputs circles: list, u: Int32, rand_seed: Int32
# ---------- randomize_form: Python ----------
__author__ = "aapolina"
__version__ = "2020.03.27"

from Rhino.Geometry import Vector3d, Curve
import math
import random 
from ghpythonlib.treehelpers import list_to_tree


n = len(circles)

if rand_seed <> None: random.seed(rand_seed)

curves = []
all_pts = []
all_cpts = []
all_rrs = []
all_trs = []

rays = [ Vector3d(math.cos(alpha), math.sin(alpha), 0 ) for alpha in [math.pi*2*i/float(u) for i in range(u)]]

for c in circles:
    cpt = c.Center
    x = cpt.X
    y = cpt.Y
    z = cpt.Z
    R = c.Radius
    
    # shift center point
    vs = Vector3d(random.uniform(-1.0,1.0)*shift_abs, random.uniform(-1.0,1.0)*shift_abs, 0) #shift absolute (m)
    #scp = rg.Vector3d(vs[0],vs[1],z) 
    scp = cpt + vs
    all_cpts.append([scp])

    #distort shape
    pts = []
    rrs = []
    trs = []
    for i in range(u):
        
        #distortion radial
        rr = random.uniform(-1.0,1.0) * distortion_abs + R #-> output rr as abs distance to centre
        rrs.append(rr)
        vrad = rays[i]
        vdr = vrad * rr 
        
        #distortion tangential
        tr = random.uniform(-1.0,1.0)
        trs.append(tr)
        vtan = Vector3d(-vrad.Y,vrad.X,0)
        vdt = vtan * tr * distortion_tan 
        
        #all distortion
        vd = vdt+vdr 
        pts.append(cpt+vd+vs)

    all_pts.append(pts)
    all_rrs.append(rrs)
    all_trs.append(trs)

    crv = Curve.CreateInterpolatedCurve(pts+[pts[0]],3)
    crv = Curve.CreatePeriodicCurve(crv)
    curves.append(crv)


all_cpts = list_to_tree(all_cpts)
all_pts = list_to_tree(all_pts)
all_rrs = list_to_tree(all_rrs)
all_trs = list_to_tree(all_trs)
# ---------- end randomize_form ----------
rrs = GhPythonScript(N=randomize_form.all_rrs)  # -> out, flat, nested; inputs N: tree
# ---------- rrs: Python ----------
__author__ = "aapolina"
__version__ = "2020.03.27"

from ghpythonlib.treehelpers import tree_to_list

nested = [list(N.Branch(b)) for b in range(N.BranchCount)]

flat = [ a for level in nested for a in level ]
# ---------- end rrs ----------
xyz = GhPythonScript(P=randomize_form.all_pts)  # -> out, flat, nested; inputs P: tree of Point3d
# ---------- xyz: Python ----------
__author__ = "aapolina"
__version__ = "2020.03.27"


P = [list(P.Branch(b)) for b in range(P.BranchCount)]

nested = [[a for p in level for a in [p.X,p.Y,p.Z]] for level in P ]

flat = [ a for level in P for p in level for a in [p.X,p.Y,p.Z]]
# ---------- end xyz ----------
cpt = GhPythonScript(P=randomize_form.all_cpts)  # -> out, flat, nested; inputs P: tree of Point3d; same code as xyz
trs = GhPythonScript(N=randomize_form.all_trs)  # -> out, flat, nested; inputs N: tree; disabled; same code as rrs
data = GhPythonScript(cpt=cpt.nested, rrs=rrs.nested)  # -> out, cpt_rrs; inputs cpt: list, rrs: list
# ---------- data: Python ----------
__author__ = "aapolina"
__version__ = "2020.06.24"

assert len(cpt)==len(rrs)

cpt_rrs = zip(cpt,rrs)
print cpt_rrs[0]
# ---------- end data ----------
generated_top_curves = Curve(randomize_form.curves)
output_cpt_rrs = Data(data.cpt_rrs)
# format: n: number of levels/chalices
# k: number of points per level
# 
# -------------------------------
# xyz:
# 
# [[L0],..,[Ln]] where
# [Li] = [xi0,yi0,zi0,...,xik,yik,zik]
# 
# 
# -------------------------------
# cpt_rrs:
# 
# [[L0],..,[Ln]] where
# [Li] = [[cix,ciy,ciz],[ri0,...,rik]]
# c: centre point
# r: polar absolute distance to centre point
output_xyz = Data(xyz.nested)
predicted_top_curves = Curve(flatten(intcrv.Curve))
choose_mode = GhPythonScript(
    mode=panel_5,
    generated=flatten(generated_top_curves),
    predicted=flatten(predicted_top_curves),
    manual=flatten(set_multiple_curves))  # -> out, selected; inputs mode: Int32, generated: list, predicted: list, manual: list
# ---------- choose_mode: Python ----------
__author__ = "aapolina"
__version__ = "2020.06.12"

selected = None

if   mode == 0: selected = generated
elif mode == 1: selected = predicted
elif mode == 2: selected = manual
else: print("wrong mode")
# ---------- end choose_mode ----------
top_curves = Geometry(choose_mode.selected)

# ----
# Support columns
min_dist_to_edge_m = Slider(0, range=0..1)
top_curves_2 = Geometry(top_curves)
support_columns = GhPythonScript(curves=top_curves_2, grid=support_points_grid, edge_distance=min_dist_to_edge_m)  # -> out, regions, pts_at_floor, simplify(pts_at_level), columns_full, simplify(columns_split), test; inputs curves: list of Curve, grid: list of Point3d
# ---------- support_columns: Python ----------
__author__ = "aapolina"
__version__ = "2020.03.27"

import rhinoscriptsyntax as rs
import Rhino.Geometry as rg
from ghpythonlib.treehelpers import list_to_tree


pln = rg.Plane.WorldXY
not_outside = (rg.PointContainment.Coincident, rg.PointContainment.Inside)

pts_at_floor = []
pts_at_level = []
columns_full = []
columns_split = []
supports_per_level = []


# filter grid points within design boundary
curves_at_floor = [rg.Curve.ProjectToPlane(c,pln) for c in curves]
regions = rg.Curve.CreateBooleanUnion(curves_at_floor)
GP = [p for p in grid for r in regions if r.Contains(p) in not_outside]

pts_at_level = [[] for _ in range(len(curves))] #dummy to fill

# find support points per curve -> columns
Z = [c.PointAt(0).Z for c in curves] #z levels
test= []

for gp in GP:
    x=gp.X
    y=gp.Y
    col_z = []
    for i,[c,z] in enumerate(zip(curves_at_floor,Z)):
        circles = [c]
        if c.Contains(gp) in not_outside:
            
            if c.PointAt(c.ClosestPoint(gp)[1]).DistanceTo(gp) > edge_distance - 1e-5: 
                # not helping much yet
                col_z.append(z)
                
                pts_at_level[i].append(rg.Point3d(x,y,z))
            else:
                print x,y,z
                circ = rg.Circle(rg.Point3d(x,y,0), edge_distance).ToNurbsCurve()
                circles.append(circ)
                #test.append(circ)
        """
        if len(circles)>1:
            print circles
            cx = rg.Curve.CreateBooleanUnion(circles)
            if cx:
                
                test.append(cx[0])"""

    if len(col_z)<1: 
        print "REMOVING a grid point!"
        continue
    else:
        pts_at_floor.append(gp)

    supports_per_level.append(len(col_z))
    col_z.sort()
    col_pts = [rg.Point3d(x,y,z) for z in col_z]
    columns_full.append(rg.Line(gp, rg.Vector3d(0,0,col_z[-1])))
    
    col_z=[0.0]+col_z
    segments = [rg.Line(rg.Point3d(x,y,col_z[i]), rg.Point3d(x,y,col_z[i+1])) for i in range(len(col_z)-1)]
    columns_split.append(segments)



pts_at_level = list_to_tree(pts_at_level)
columns_split = list_to_tree(columns_split)
# ---------- end support_columns ----------
region_s = Curve(support_columns.regions)
support_points_at_floor = Point(support_columns.pts_at_floor)
support_points_at_level = Point(support_columns.pts_at_level)
column_segments = Curve(support_columns.columns_split)
column_lines = Curve(support_columns.columns_full)

max_bending_length = Slider(5.067, range=0..10)
support_points_at_level_2 = Point(support_points_at_level)
# Assess geometry
columns_segments = Curve(support_columns.columns_split)
support_points_at_floor_2 = Point(support_points_at_floor)
support_points_at_level_3 = Point(support_points_at_level)
stability = GhPythonScript(P=support_points_at_level_2)  # -> out, hulls, flatten(supports_ok); inputs P: list of Point3d
# ---------- stability: Python ----------
__author__ = "aapolina"
__version__ = "2020.06.12"

import ghpythonlib as ghp
import Rhino.Geometry as rg

pts = P

tol = 1e-3

supports_ok = None

if len(pts)<3:
    supports_ok = False
else:
    hull = ghp.components.ConvexHull(pts)[1].ToNurbsCurve()
    area = rg.AreaMassProperties.Compute(hull).Area
    if area < tol: 
        #area nearly zero --> supports co-linear
        supports_ok = False
    else: supports_ok = True
# ---------- end stability ----------
columns_stats = GhPythonScript(lines=flatten(columns_segments), max_length=max_bending_length)  # -> out, total_length, average_length, shortest, longest, exceeding_max_length; inputs lines: list of Line
# ---------- columns_stats: Python ----------
__author__ = "aapolina"
__version__ = "2020.03.27"

import rhinoscriptsyntax as rs

L = [l.Length for l in lines]
total_length = sum(L)
average_length = sum(L)/len(L)

shortest = min(L)
longest = max(L)
exceeding_max_length = sum([1 for x in L if x>max_length])
# ---------- end columns_stats ----------
stability_2 = GhPythonScript(P=support_points_at_level_3)  # -> out, n_unstable, indices_unstable; inputs P: tree of Point3d
# ---------- stability_2: Python ----------
__author__ = "aapolina"
__version__ = "2020.03.27"

import rhinoscriptsyntax as rs


n_unstable = 0
indices_unstable = [] 
min_supports_per_chalice = 3

for b,branch in enumerate(P.Branches):
    if len(branch)<min_supports_per_chalice:
        indices_unstable.append(b)
        n_unstable+=1
# ---------- end stability_2 ----------
lng = ListLength(List=support_points_at_floor_2)
supports_ok = Panel(stability.supports_ok)
number_of_supports = Panel(lng)
_3_supports_per_level = Panel(stability_2.n_unstable)
panel_9 = Panel(stability_2.indices_unstable)
ghpython_script = GhPythonScript(x=flatten(supports_ok))  # -> out, all_supports_ok; inputs x: list of Boolean
# ---------- ghpython_script: Python ----------
__author__ = "aapolina"
__version__ = "2020.06.12"

all_supports_ok = all(x)
# ---------- end ghpython_script ----------
m = Panel(columns_stats.total_length)
m_2 = Panel(columns_stats.shortest)
panel_10 = Panel(columns_stats.exceeding_max_length)
m_3 = Panel(columns_stats.average_length)
m_4 = Panel(columns_stats.longest)
bool = Boolean(_3_supports_per_level)
all_supports_ok = Panel(ghpython_script.all_supports_ok)
problem = Panel(bool)

min_dist_to_edge_m_2 = Slider(0.47, range=0..1)
support_points_at_level_4 = Point(support_columns.pts_at_level)
top_curves_3 = Geometry(top_curves)
edge = GhPythonScript(curve=top_curves_3, pts=support_points_at_level_4, min_edge_dist=min_dist_to_edge_m_2)  # -> out; inputs curve: Curve, pts: list of Point3d
# ---------- edge: Python ----------
__author__ = "aapolina"
__version__ = "2020.03.27"

import Rhino.Geometry as rg


x = []
for p in pts:
    d = curve.PointAt(curve.ClosestPoint(p)[1]).DistanceTo(p)
    if d<min_edge_dist:
        x.append(d)

if not x: pass #print 'All supports ok'
else: print '%s: %s'%(len(x),['%.2f'%i for i in x])
# ---------- end edge ----------
n_supports_too_close_to_edge = Panel(edge)

# ----
# error: sometimes max_cantilever = None
support_points_at_level_5 = Point(support_columns.pts_at_level)  # disabled
top_curves_4 = Geometry(top_curves)  # disabled
cantilever = GhPythonScript(curves=top_curves_4, support_pts=support_points_at_level_5)  # -> out, max_cantilever, cantilevers, vizualize, hulls; inputs curves: list of Curve, support_pts: tree of Point3d; disabled
# ---------- cantilever: Python ----------
__author__ = "aapolina"
__version__ = "2020.03.27"

import Rhino.Geometry as rg
import ghpythonlib as ghp


"""
curves: chalice edge curves at levels
support_pts: per curve, at levels
"""
assert len(curves) == support_pts.BranchCount 
n = len(curves)
spts = [list(branch) for branch in support_pts.Branches]

cantilevers = []
vizualize = []

hulls = [ghp.components.ConvexHull(pts)[1].ToNurbsCurve() for pts in spts]

divc = 50
for c,h in zip(curves,hulls):
    cpts = [c.PointAt(t) for t in c.DivideByCount(divc,True)]
    hpts = [h.PointAt(h.ClosestPoint(p)[1]) for p in cpts]
    d = [cp.DistanceTo(hp) for cp,hp in zip(cpts,hpts)]
    #vizualize.extend([rg.Line(cp,hp) for cp,hp in zip(cpts,hpts)])
    
    chd = zip(cpts,hpts,d)
    chd.sort(key = lambda x: -x[2])
    
    cantilevers.append(chd[0][2])
    vizualize.append(rg.Line(chd[0][0], chd[0][1]))
 
max_cantilever = max(cantilevers)
# ---------- end cantilever ----------
swatch = ColourSwatch(SwatchColor=RGB(77, 255, 225))  # disabled
m_5 = Panel(cantilever.max_cantilever)  # disabled
m_6 = Panel(cantilever.cantilevers)  # disabled
preview = CustomPreview(Geometry=[cantilever.hulls, cantilever.vizualize], Material=swatch)  # disabled

top_curves_5 = Geometry(top_curves)
pt = Point(Point(0, 0, 0))
top_curves_6 = Geometry(top_curves)
bbox = BoundingBox(Content=flatten([top_curves_5, pt]), Plane=PlaneXY(0, 0, 0), UnionBox=True)  # -> Box, Box_2
area = GhPythonScript(C=top_curves_6)  # -> out, area_min, area_max, area_total, areas; inputs C: list of Curve
# ---------- area: Python ----------
__author__ = "aapolina"
__version__ = "2020.03.30"

import rhinoscriptsyntax as rs
import Rhino.Geometry as rg

areas = [rg.AreaMassProperties.Compute(c).Area for c in C]


area_min = round(min(areas),1)
area_max = round(max(areas),1)
area_total = round(sum(areas),1)
areas = [round(a,1) for a in areas]
# ---------- end area ----------
outline_lentgh = GhPythonScript(C=top_curves_6)  # -> out, crv_min, crv_max, crv_total, crv_lengths; inputs C: list of Curve
# ---------- outline_lentgh: Python ----------
__author__ = "aapolina"
__version__ = "2020.03.30"

import rhinoscriptsyntax as rs
import Rhino.Geometry as rg

L = [c.GetLength() for c in C]


crv_min = round(min(L),1)
crv_max = round(max(L),1)
crv_total = round(sum(L),1)
crv_lengths = [round(a,1) for a in L]
# ---------- end outline_lentgh ----------
boxprop = BoxProperties(Box=bbox.Box)  # -> Center, Diagonal, Area, Volume, Degeneracy
m2 = Panel(area.area_max)
m2_2 = Panel(area.areas)
m2_3 = Panel(area.area_min)
pdecon = Deconstruct(Point=boxprop.Diagonal)  # -> XComponent, YComponent, ZComponent
m2_4 = Panel(area.area_total)
m_7 = Panel(outline_lentgh.crv_total)
m_8 = Panel(outline_lentgh.crv_lengths)
m_9 = Panel(outline_lentgh.crv_min)
m_10 = Panel(outline_lentgh.crv_max)
m_11 = Panel(pdecon.XComponent)
m_12 = Panel(pdecon.YComponent)
m_13 = Panel(pdecon.ZComponent)

# ----
# /!\
# error trap needed if more than one region curve found
plot_boundary = Curve(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)
region_s_2 = Curve(region_s)

# ----
# Fit to plot to region
# adding a small extra offset
# so that no intersection with the border
# is detected where the region
# "touches" the border
m_14 = Panel(".02")  # disabled
cluster = Cluster(plot_boundary=plot_boundary, region_s=region_s_2, tolerance=m_14)  # -> plot_boundary_position_adjusted_2, region_position_adjusted_2; disabled
region_position_adjusted = Curve(cluster.region_position_adjusted_2)  # disabled
plot_boundary_position_adjusted = Curve(cluster.plot_boundary_position_adjusted_2)  # disabled

top_curves_7 = Geometry(top_curves)
cx = CurveSelf(Curve=flatten(top_curves_7))  # -> Points, Params
lng_2 = ListLength(List=cx.Points)
self_intersections = Panel(lng_2)
ma = MassAddition(Input=flatten(self_intersections))  # -> flatten(Result), PartialResults
int_2 = Integer(ma.Result)

support_radius = Slider(0.16, range=0..1)
pipe = Pipe(Curve=column_segments, Radius=support_radius, Caps=1)  # disabled
preview_2 = CustomPreview(Geometry=[pipe, column_lines], Material=ColourSwatch(SwatchColor=RGB(160, 150, 120)))

# ----
# Check fit to plot
ccx = CurveCurve(CurveA=plot_boundary_position_adjusted, CurveB=region_s_2)  # -> Points, ParamsA, ParamsB; disabled
lng_3 = ListLength(List=ccx.Points)  # disabled
pt_2 = Point(ccx.Points)  # disabled
number_of_intersections = Panel(lng_3)  # disabled
int_3 = Integer(number_of_intersections)  # disabled

# ----
# Curvature
top_curves_8 = Curve(top_curves)  # disabled
radius_constraint_m = Panel("2.50")  # disabled
crv = Curve(top_curves_8)  # disabled
python_3 = GhPythonScript(crv=crv, r_outside=radius_constraint_m, r_inside=radius_constraint_m)  # -> out, min_outside, ok_outside, tco, pco, vco, port, min_inside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; inputs crv: Curve; disabled
# ---------- python_3: Python ----------
__author__ = "aapolina"
__version__ = "2020.06.17"

import rhinoscriptsyntax as rs

import Rhino.Geometry as rg
import copy


d0, d1 = crv.Domain
print d0,d1


mino = 1e5
pco = None
vco = None
tco = None
mini = 1e5
pci = None
vci = None
tci = None



n=100
for i in range(n):
    t = d0 + i*(d1-d0)/n
    v = crv.CurvatureAt(t)
    r = 1/(v.Length)
    
    #check inside/outside
    vu = copy.deepcopy(v)
    vu.Unitize()
    px = crv.PointAt(t)+vu*0.1
    x = crv.Contains(px)

    if x == rg.PointContainment.Outside and r<mino:
        mino = r
        pco = crv.PointAt(t)
        vco = v*r*r
        tco = t
        print "outside", t, r
    elif x == rg.PointContainment.Inside and r<mini:
        mini = r
        pci = crv.PointAt(t)
        vci = v*r*r
        tci = t
        print "inside", t, r

min_outside = mino
min_inside = mini

ok_outside = mino>r_outside
ok_inside = mini>r_inside
# ---------- end python_3 ----------
vdis = VectorDisplay(Anchor=python_3.pco, Vector=python_3.vco)  # disabled
vdis_2 = VectorDisplay(Anchor=python_3.pci, Vector=python_3.vci)  # disabled
curvature = Curvature(Curve=crv, Parameter=python_3.tco)  # -> P, K, C; disabled
curvature_2 = Curvature(Curve=crv, Parameter=python_3.tci)  # -> P, K, C; disabled
panel_11 = Panel(python_3.ok_outside)  # disabled
panel_12 = Panel(python_3.ok_inside)  # disabled

# ----
# Chalice surfaces
top_curves_9 = Curve(top_curves)
boundary = BoundarySurfaces(Edges=top_curves_9)  # -> simplify(Surfaces)
chalice_surface = Geometry(boundary)
preview_3 = CustomPreview(Geometry=chalice_surface, Material=ColourSwatch(SwatchColor=RGB(164, 222, 89)))  # disabled

# ----
# Chalices Visualisation
z_min = Slider(-1, range=-4..0)  # disabled
z_max = Slider(-2, range=-4..0)  # disabled
top_curves_10 = Geometry(top_curves)  # disabled
pln = Plane(top_curves_10)  # disabled
lng_4 = ListLength(List=support_points_at_level)  # -> flatten(Length); disabled
ma_2 = MassAddition(Input=lng_4)  # -> Result, PartialResults; disabled
dom = ConstructDomain(DomainStart=z_min, DomainEnd=z_max)  # disabled
random = Random(Range=dom, Number=ma_2.Result, Seed=seed_2)  # -> flatten(Random); disabled
vec = VectorXYZ(XComponent=0, YComponent=0, ZComponent=random)  # -> Vector, Length; disabled
divide = DivideCurve(Curve=top_curves_10, Count=32, Kinks=False)  # -> simplify(Points), Tangents, Parameters; disabled
move = Move(Geometry=flatten(support_points_at_level), Motion=vec.Vector)  # -> Geometry, Transform; disabled
facen = FaceNormals(Mesh=pln)  # -> Centers, Normals; disabled
pt_3 = Point(move.Geometry)  # disabled
pt_4 = Point(divide.Points)  # disabled
devec = DeconstructVector(Vector=facen.Centers)  # -> XComponent, YComponent, ZComponent; disabled
unflatten = UnflattenTree(Tree=pt_3, Guide=support_points_at_level)  # disabled
subtraction = Subtraction(A=devec.ZComponent, B=0.02)  # disabled
merge = Merge(Data1=unflatten, Data2=pt_4)  # disabled
vec_2 = VectorXYZ(XComponent=0, YComponent=0, ZComponent=subtraction)  # -> Vector, Length; disabled
material = CreateMaterial(Diffuse=RGB(255, 210, 181), Specular=RGB(255, 255, 255), Emission=RGB(78, 80, 52), Transparency=0, Shine=0)  # disabled
pln_2 = Plane(Plane(origin=(0, 0, 0), x=(0, 1, 0), y=(-1, 0, 0)))  # disabled
del = DelaunayMesh(Points=merge)  # disabled
move_2 = Move(Geometry=pln_2, Motion=vec_2.Vector)  # -> Geometry, Transform; disabled
msplit = MeshSplitPlane(Mesh=del, Plane=move_2.Geometry)  # -> Above, Below; disabled
swatch_2 = ColourSwatch(SwatchColor=RGB(160, 150, 120))  # disabled
unim = UnifyMesh(Mesh=msplit.Below)  # -> Result, Count; disabled
preview_4 = CustomPreview(Geometry=unim.Result, Material=swatch_2)  # disabled

# ----
# Curve Projection
crv_2 = Curve(top_curves)  # disabled
boundary_2 = BoundarySurfaces(Edges=crv_2)  # disabled
lng_5 = ListLength(List=crv_2)  # disabled
subtraction_2 = Subtraction(A=lng_5, B=1)  # disabled
series = Series(Start=0, Step=1, Count=subtraction_2)  # disabled
start_crv_idx = Integer(series)  # disabled
addition = Addition(A=series, B=1)  # disabled
subtraction_3 = Subtraction(A=subtraction_2, B=series)  # disabled
series_2 = Series(Start=addition, Step=1, Count=subtraction_3)  # disabled
item = ListItem(List=boundary_2, Index=start_crv_idx, Wrap=True)  # disabled
intersect_crv_idx = Integer(series_2)  # disabled
item_2 = ListItem(List=crv_2, Index=intersect_crv_idx, Wrap=True)  # disabled
project = Project(Curve=item_2, Brep=item, Direction=Vector(0, 0, 1))  # disabled

bake = BooleanToggle(False)

merge_2 = Merge(Data1=chalice_surface, Data2=pipe, Data3=unim.Result, Data4=project)  # disabled
dispatch = Dispatch(List=merge_2, DispatchPattern=bake)  # -> ListA, ListB; disabled

# ----
# Rain occlusion
subtraction_4 = Subtraction(A=number_of_circles, B=2)
dom_2 = ConstructDomain(DomainStart=0, DomainEnd=subtraction_4)
vec_3 = VectorXYZ(XComponent=0, YComponent=0, ZComponent=-1)  # -> Vector, Length

# ----
# Sun occlusion
number_slider = Slider(25, range=0..100)
chalice_surface_2 = Geometry(chalice_surface)
mesh_uv = MeshSurface(Surface=flatten(chalice_surface_2), UCount=Slider(25, range=0..100), VCount=number_slider, Overhang=True, Equalize=False)
demesh = DeconstructMesh(Mesh=mesh_uv)  # -> Vertices, Faces, Colours, Normals

subset = SubList(List=mesh_uv, Domain=dom_2, Wrap=False)  # -> flatten(List), Index
demesh_2 = DeconstructMesh(Mesh=subset.List)  # -> Vertices, Faces, Colours, Normals
occ = Occlusion(Samples=demesh_2.Vertices, Obstructions=flatten(mesh_uv), Rays=vec_3.Vector)  # -> Hits, Occlusion
bnd = Bounds(Numbers=occ.Hits)
dedomain = DeconstructDomain(Domain=bnd)  # -> Start, End
gradient = Gradient(LowerLimit=dedomain.Start, UpperLimit=dedomain.End, Parameter=occ.Hits, stops=[0: RGB(255, 255, 255), 1: RGB(0, 0, 0)])  # disabled
flatten = FlattenTree(Tree=occ.Occlusion, Path="{0}")
ma_3 = MassAddition(Input=flatten(occ.Hits))  # -> Result, PartialResults
lng_6 = ListLength(List=flatten)
conmesh = ConstructMesh(Vertices=demesh_2.Vertices, Faces=demesh_2.Faces, Colours=gradient)  # disabled
division = Division(A=ma_3.Result, B=lng_6)
multiplication = Multiplication(A=division, B=100)
rain_occluded_rays_w_o_top_chalice_minim = Panel(multiplication)  # "rain occluded rays w/o top chalice % (minimize)"

preview_5 = CustomPreview(
    Geometry=conmesh,
    Material={diffuse=RGB(221, 160, 221), emission=RGB(66, 48, 66), shine=0.5, specular=RGB(255, 255, 255), transparency=0})  # disabled
output_rain_occlusion = Data(multiplication)

# ---- group: Sun simulation
range = Range(Domain="10 to 16", Steps="3")
range_2 = Range(Domain="1 to 6", Steps="6")

# ---- group: Sun simulation / Sun position calculator
X = UnitX(Factor=1)
Z = UnitZ(Factor=1)
sun_angles = CSharpScript(
    GMT=Slider(2, range=0..23),
    Hour=range,
    DayOfMonth=Slider(21, range=0..31),
    Month=range_2,
    Year=Slider(2020, range=1970..2050),
    Latitude="41.9",
    Longitude="12.4833333",
    North=X,
    Up=Z,
    DataComparison="cross_reference")  # -> out, azimuth, altitude, direction; inputs GMT: Int32, Hour: Int32, DayOfMonth: Int32, Month: Int32, Year: Int32, Latitude: Double, Longitude: Double, North: Vector3d, Up: Vector3d
# ---------- sun_angles: C# ----------
    // Implementation in C# by Mikael Nillsson
    // http://guideving.blogspot.nl/2010/08/sun-position-in-c.html
    // Adaptation to Grasshopper By Arend van Waart <Arendvw@gmail.com>
    // @see http://stackoverflow.com/questions/8708048/position-of-the-sun-given-time-of-day-latitude-and-longitude

    North.Unitize();
    Up.Unitize();


    DateTime time = new DateTime(Year, Month, DayOfMonth, Hour, 0, 0, DateTimeKind.Utc);
    time = time.AddHours(-GMT);
    this.CalculateSunPosition(time, Latitude, Longitude);
    azimuth = this.azimuth;
    altitude = this.altitude;

    // plane: x = north; y = up
    Point3d p0 = new Point3d(0, 0, 0);
    Point3d p1 = new Point3d(1, 0, 0);
    p1.Transform(Transform.Translation(North));
    p1.Transform(Transform.Rotation(this.azimuth, Up, p0));

    Plane azPlane = new Plane(p0, new Vector3d(p1), Up);
    p1.Transform(Transform.Rotation(this.altitude, azPlane.ZAxis, p0));
    Vector3d dir = new Vector3d(p1);
    dir.Unitize();
    direction = dir;
# ---------- sun_angles: C# additional code ----------
  private const double Deg2Rad = Math.PI / 180.0;
  private const double Rad2Deg = 180.0 / Math.PI;
  private double altitude;
  private double azimuth;

    /*!
     * \brief Calculates the sun light.
     *
     * CalcSunPosition calculates the suns "position" based on a
     * given date and time in local time, latitude and longitude
     * expressed in decimal degrees. It is based on the method
     * found here:
     * http://www.astro.uio.no/~bgranslo/aares/calculate.html
     * The calculation is only satisfiably correct for dates in
     * the range March 1 1900 to February 28 2100.
     * \param dateTime Time and date in local time.
     * \param latitude Latitude expressed in decimal degrees.
     * \param longitude Longitude expressed in decimal degrees.
     */
  public void CalculateSunPosition(
    DateTime dateTime, double latitude, double longitude)
  {
    // Convert to UTC
    dateTime = dateTime.ToUniversalTime();

    // Number of days from J2000.0.
    double julianDate = 367 * dateTime.Year -
      (int) ((7.0 / 4.0) * (dateTime.Year +
      (int) ((dateTime.Month + 9.0) / 12.0))) +
      (int) ((275.0 * dateTime.Month) / 9.0) +
      dateTime.Day - 730531.5;

    double julianCenturies = julianDate / 36525.0;

    // Sidereal Time
    double siderealTimeHours = 6.6974 + 2400.0513 * julianCenturies;

    double siderealTimeUT = siderealTimeHours +
      (366.2422 / 365.2422) * (double) dateTime.TimeOfDay.TotalHours;

    double siderealTime = siderealTimeUT * 15 + longitude;

    // Refine to number of days (fractional) to specific time.
    julianDate += (double) dateTime.TimeOfDay.TotalHours / 24.0;
    julianCenturies = julianDate / 36525.0;

    // Solar Coordinates
    double meanLongitude = CorrectAngle(Deg2Rad *
      (280.466 + 36000.77 * julianCenturies));

    double meanAnomaly = CorrectAngle(Deg2Rad *
      (357.529 + 35999.05 * julianCenturies));

    double equationOfCenter = Deg2Rad * ((1.915 - 0.005 * julianCenturies) *
      Math.Sin(meanAnomaly) + 0.02 * Math.Sin(2 * meanAnomaly));

    double elipticalLongitude =
      CorrectAngle(meanLongitude + equationOfCenter);

    double obliquity = (23.439 - 0.013 * julianCenturies) * Deg2Rad;

    // Right Ascension
    double rightAscension = Math.Atan2(
      Math.Cos(obliquity) * Math.Sin(elipticalLongitude),
      Math.Cos(elipticalLongitude));

    double declination = Math.Asin(
      Math.Sin(rightAscension) * Math.Sin(obliquity));

    // Horizontal Coordinates
    double hourAngle = CorrectAngle(siderealTime * Deg2Rad) - rightAscension;

    if (hourAngle > Math.PI)
    {
      hourAngle -= 2 * Math.PI;
    }

    this.altitude = Math.Asin(Math.Sin(latitude * Deg2Rad) *
      Math.Sin(declination) + Math.Cos(latitude * Deg2Rad) *
      Math.Cos(declination) * Math.Cos(hourAngle));

    // Nominator and denominator for calculating Azimuth
    // angle. Needed to test which quadrant the angle is in.
    double aziNom = -Math.Sin(hourAngle);
    double aziDenom =
      Math.Tan(declination) * Math.Cos(latitude * Deg2Rad) -
      Math.Sin(latitude * Deg2Rad) * Math.Cos(hourAngle);

    this.azimuth = Math.Atan(aziNom / aziDenom);

    if (aziDenom < 0) // In 2nd or 3rd quadrant
    {
      this.azimuth += Math.PI;
    }
    else if (aziNom < 0) // In 4th quadrant
    {
      this.azimuth += 2 * Math.PI;
    }

    // Altitude
    //Console.WriteLine("Altitude: " + altitude * Rad2Deg);

    // Azimut
    //Console.WriteLine("Azimuth: " + azimuth * Rad2Deg);
  }

    /*!
    * \brief Corrects an angle.
    *
    * \param angleInRadians An angle expressed in radians.
    * \return An angle in the range 0 to 2*PI.
    */
  private static double CorrectAngle(double angleInRadians)
  {
    if (angleInRadians < 0)
    {
      return 2 * Math.PI - (Math.Abs(angleInRadians) % (2 * Math.PI));
    }
    else if (angleInRadians > 2 * Math.PI)
    {
      return angleInRadians % (2 * Math.PI);
    }
    else
    {
      return angleInRadians;
    }
  }
# ---------- end sun_angles ----------

# ---- group: Sun simulation (continued)
rotate = Rotate(Geometry=sun_angles.direction, Angle=1.570796327, Plane=PlaneXY(0, 0, 0))  # -> Geometry, Transform
sun_viz = _sunViz(V=rotate.Geometry, num="10")  # -> L, S; disabled

# ----
rev = Reverse(Vector=rotate.Geometry)
occ_2 = Occlusion(Samples=simplify(demesh.Vertices), Obstructions=flatten(mesh_uv), Rays=rev)  # -> Hits, flatten(Occlusion)
bnd_2 = Bounds(Numbers=occ_2.Hits)
dedomain_2 = DeconstructDomain(Domain=bnd_2)  # -> Start, End
gradient_2 = Gradient(
    LowerLimit=dedomain_2.Start,
    UpperLimit=dedomain_2.End,
    Parameter=occ_2.Hits,
    stops=[0: RGB(255, 255, 255), 1: RGB(0, 0, 0)])  # disabled
ma_4 = MassAddition(Input=flatten(occ_2.Hits))  # -> Result, PartialResults
lng_7 = ListLength(List=occ_2.Occlusion)
division_2 = Division(A=ma_4.Result, B=lng_7)
multiplication_2 = Multiplication(A=division_2, B=100)
sun_occluded_rays_minimize = Panel(multiplication_2)
sun_occluded_rays = Panel(ma_4.Result)
conmesh_2 = ConstructMesh(Vertices=demesh.Vertices, Faces=demesh.Faces, Colours=gradient_2)  # disabled
preview_6 = CustomPreview(
    Geometry=conmesh_2,
    Material={diffuse=RGB(221, 160, 221), emission=RGB(66, 48, 66), shine=0.5, specular=RGB(255, 255, 255), transparency=0})  # disabled

# ----
# Summary
data_summary = GhPythonScript(
    generation=int,
    box_length=m_11,
    box_width=m_12,
    box_height=m_13,
    surface_area_total=m2_4,
    outline_length_total=m_7,
    outlines_bleps=int_2,
    parcel_intersection=int_3,
    supports_count=number_of_supports,
    supports_problems=problem,
    columns_max_length=m_4,
    cantilever_max=m_5,
    occlusion_sun=multiplication_2,
    occlusion_rain=multiplication)  # -> out, txt, dict; inputs generation: Int32, supports_count: Int32
# ---------- data_summary: Python ----------
dict = {}
dict['generation']=generation
dict['box_length']=box_length
dict['box_width']=box_width
dict['box_height']=box_height
dict['surface_area_total']=surface_area_total
dict['outline_length_total']=outline_length_total
dict['outlines_bleps']=outlines_bleps
dict['parcel_intersection']=parcel_intersection
dict['supports_count']=supports_count
dict['supports_problems']=supports_problems
dict['columns_max_length']=columns_max_length
dict['cantilever_max']=cantilever_max
dict['occlusion_sun']=occlusion_sun
dict['occlusion_rain']=occlusion_rain

#dict['']=


txt=""
for k in dict.keys():
    txt+="{}: {}\n".format(k,dict[k])


#----------------------------------------------------
dict= [dict] #need to "hide" the dictionary into a list to parse it between components
# ---------- end data_summary ----------
panel_13 = Panel(data_summary.txt)
data_output = GhPythonScript(
    g=generation_2,
    include_invalid=include_invalid,
    input_selector=list_2,
    cpts_rrs=output_cpt_rrs,
    xyz_pts=output_xyz,
    labels=data_summary.dict)  # -> out, output_data; inputs g: Int32, include_invalid: Boolean, input_selector: Int32, cpts_rrs: list, xyz_pts: list, labels: list
# ---------- data_output: Python ----------
if True:
    dict = labels[0] #unpack from list
    design_is_valid =  (dict['outlines_bleps'] == 0 and dict['parcel_intersection'] == 0 and dict['supports_problems'] == False )

    if design_is_valid or include_invalid:
        
        #write geometry data as selected
        if input_selector == 0:
            geo = {'xyz':xyz_pts}
        elif input_selector == 1:
            geo = {'cpts_rrs':cpts_rrs }
        elif input_selector == 2:
            geo = {'xyz':xyz_pts, 'cpts_rrs':cpts_rrs }
        info = {
            'generation':g,
            }
        labels = {
            'buildable': design_is_valid,
            'surface_area_total':dict['surface_area_total'], 
            'outline_length_total':dict['outline_length_total'], 
            'occlusion_sun':dict['occlusion_sun'], 
            'occlusion_rain':dict['occlusion_rain'], 
            'cantilever_max':dict['cantilever_max'], 
            'supports_count':dict['supports_count'], 
            'columns_max_length':dict['columns_max_length'],
            'outlines_bleps':dict['outlines_bleps'],
            'parcel_intersection':dict['parcel_intersection'],
            'supports_problems':dict['supports_problems'],
            }
        
        output_data = [{'info':info, 'geo': geo, 'labels':labels}]
        
    else:
        print "invalid"
# ---------- end data_output ----------
tag = TextTag3D(Location=PlaneXY(9, 5, 0), Text=data_summary.txt, Size=0.5, Colour=RGB(0, 0, 0), Justification=7)
output_all_data = Data(flatten(data_output.output_data))
panel_14 = Panel(output_all_data)  # disabled

# ==== cluster _sunViz
V = ClusterInput()
num = ClusterInput()
num_2 = Number(num)
pt = ConstructPoint(XCoordinate=0, YCoordinate=0, ZCoordinate=0)
amp = Amplitude(Vector=V, Amplitude=num_2)
move = Move(Geometry=pt, Motion=amp)  # -> Geometry, Transform
division = Division(A=num_2, B="40")
sph = Sphere(Base=move.Geometry, Radius=division)
ln = Line(StartPoint=pt, EndPoint=move.Geometry)
L = ClusterOutput(ln)
S = ClusterOutput(sph)

# ==== cluster Cluster
region_s = ClusterInput()
plot_boundary = ClusterInput()
tolerance = ClusterInput()
region_s_2 = Curve(region_s)
plot_boundary_2 = Curve(plot_boundary)
explode = Explode(Curve=plot_boundary_2, Recursive=True)  # -> Segments, Vertices
line = Line(explode.Segments)
python = GhPythonScript(lines=line)  # -> out, plns, lines; inputs lines: list of Line
# ---------- python: Python ----------
import Rhino.Geometry as rg

lines.sort(key = lambda l: l.Length)
lines = lines[2:]

plns = [rg.Plane(line.PointAt(0.5), line.UnitTangent, rg.Vector3d.CrossProduct(line.UnitTangent,rg.Vector3d(0,0,1))) for line in lines ]
# ---------- end python ----------
bbox = BoundingBox(Content=region_s_2, Plane=python.plns, UnionBox=True)  # -> simplify(Box), simplify(Box_2)
points = PointList(Points=python.plns, Size=1)
deplane = DeconstructPlane(Plane=python.plns)  # -> Origin, XAxis, YAxis, ZAxis
debox = DeconstructBox(Box=bbox.Box_2)  # -> Plane, X, Y, Z
dedomain = DeconstructDomain(Domain=debox.Y)  # -> Start, End
addition = Addition(A=dedomain.End, B=tolerance)
amp = Amplitude(Vector=flatten(deplane.YAxis), Amplitude=flatten(addition))
vdis = VectorDisplay(Anchor=deplane.Origin, Vector=amp)
dispatch = Dispatch(List=python.lines, DispatchPattern=[True, False])  # -> ListA, ListB
dispatch_2 = Dispatch(List=amp, DispatchPattern=[True, False])  # -> ListA, ListB
move = Move(Geometry=dispatch.ListB, Motion=dispatch_2.ListB)  # -> Geometry, Transform
move_2 = Move(Geometry=dispatch.ListA, Motion=dispatch_2.ListA)  # -> Geometry, Transform
llx = LineLine(Line1=dispatch.ListA, Line2=dispatch.ListB)  # -> ParamA, ParamB, PointA, PointB
llx_2 = LineLine(Line1=move_2.Geometry, Line2=move.Geometry)  # -> ParamA, ParamB, PointA, PointB
vec2pt = Vector2Pt(PointA=llx_2.PointA, PointB=llx.PointA, Unitize=False)  # -> Vector, Length
vdis_2 = VectorDisplay(Anchor=llx_2.PointA, Vector=vec2pt.Vector)
rev = Reverse(Vector=vec2pt.Vector)
move_3 = Move(Geometry=region_s_2, Motion=vec2pt.Vector)  # -> Geometry, Transform
move_4 = Move(Geometry=plot_boundary_2, Motion=rev)  # -> Geometry, Transform
plot_boundary_position_adjusted = Curve(move_4.Geometry)
region_position_adjusted = Curve(move_3.Geometry)
region_position_adjusted_2 = ClusterOutput(region_position_adjusted)
plot_boundary_position_adjusted_2 = ClusterOutput(plot_boundary_position_adjusted)
