# Grasshopper definition Semiramis_SDF_AA.gh (Grasshopper 1.0.7)

# Mode
# Set Geometry Input Mode
generator_mode = ValueList({"Generate from random": 0, "Generate from ML prediction": 1, "Generate from manual input": 2, "Generate form explicit input": 3}, selected="Generate from manual input")
# Install / Dependencies:
# Install compas: https://compas-dev.github.io/main/installation.html
# Add compas to Rhino: https://compas-dev.github.io/main/gettingstarted/cad/rhino.html
automatic_control = BooleanToggle(True)
timer = Timer(TimerInterval=1, Target=generator)  # disabled
# Generation counter
run = BooleanToggle(False)  # disabled
reset = Button()  # disabled
generation_number = Integer(0)
generator_mode_2 = Data(3)
include_invalid = BooleanToggle(True)
generator = PythonScript(Run=run, Reset=reset)  # -> g, t; inputs Run: Boolean, Reset: Boolean; disabled
# ---------- generator: Python ----------
import time


"""
if it doesn't run (= static): g = 0 --> reset g  to 0
if it runs: g starts at 0
if reset: g starts from 0 again
"""


#set default at start only
if 'counter' not in globals():
    counter = -1 

#reset & idle
if Reset or not Run:
    counter = -1

if Run:
    counter += 1 
    t = time.ctime()

g = 0 if counter < 0 else counter # "stop" and counter=0 will both render =0
# ---------- end generator ----------
panel = Panel(generation_number)
panel_2 = Panel(generator_mode)
# legend:: Generate from random  = 0
# Generate from ML prediction = 1
# Generate from manual input = 2
# Generate form explicit input = 3
panel_3 = Panel(generator_mode_2)
toggle = BooleanToggle(True)  # disabled
button = Button()  # disabled
panel_4 = Panel(generator.g)
manual_seed = Slider(10, range=0..100)
controller = GhPythonScript(control=automatic_control, manual_val=panel_2, automatic_val=panel_3)  # -> out, val; inputs manual_val: Int32, automatic_val: Int32
# ---------- controller: Python ----------
__author__ = "aapolina"
__version__ = "2020.06.24"


if control == True:
    val = automatic_val
elif control == False:
    val = manual_val
# ---------- end controller ----------
controller_2 = GhPythonScript(control=automatic_control, manual_val=panel_4, automatic_val=panel)  # -> out, val; inputs manual_val: Int32, automatic_val: Int32; same code as controller

# ----
# set to "no seed"
# for generating batches
# if reproducibility not needed
list = ValueList({"no seed": 0, "seed from generation": 1, "manual seed": 2}, selected="no seed")

set_config_values = GhPythonScript(active=toggle, refresh=button)  # -> out; inputs active: Boolean; disabled
# ---------- set_config_values: Python ----------
import Grasshopper
from compas_ghpython.utilities import unload_modules
unload_modules('semiramis_design')
import semiramis_design.py.config_design as conf

doc = Grasshopper.Instances.ActiveCanvas.Document

def FindBatteryByNickname(docObjects, name):
    if docObjects is None: return None

    for obj in docObjects:
        attr = obj.Attributes

        if attr.PathName == name:
            return obj
    raise Exception(name + " was not found in document")

def set_slider_value(slider_name, val):
    bat = FindBatteryByNickname(doc.Objects, slider_name)
    bat.Slider.Value = val
    bat.ExpireSolution(True)

def set_list_value(slider_name, val):
    pass

if active:
    # --- general setout ---
    set_slider_value('N_CHALICES', conf.N_CHALICES)
    
    set_slider_value('Z_LOWEST', conf.Z_RANGE[0])
    set_slider_value('Z_HIGHEST', conf.Z_RANGE[1])
    set_slider_value('Z_DIST_MIN', conf.Z_DIST_MIN)
    
    set_slider_value('GRID_ORIGIN_X', conf.GRID_ORIGIN_XY[0])
    set_slider_value('GRID_ORIGIN_Y', conf.GRID_ORIGIN_XY[1])
    set_slider_value('GRID_UNIT', conf.GRID_UNIT)
    set_slider_value('GRID_ROTATION', conf.GRID_ROTATION)
    
    
    # --- random circle distorion ---
    set_slider_value('CIRCLES_ORIGIN_X', conf.CIRCLES_ORIGIN_XY[0])
    set_slider_value('CIRCLES_ORIGIN_Y', conf.CIRCLES_ORIGIN_XY[1])
    set_slider_value('K_POINTS', conf.K_POINTS)
    set_slider_value('RADIUS', conf.RADIUS)
    set_slider_value('DISTORTION_TAN_RAND_MAX', conf.DISTORTION_TAN_RAND_MAX)
    set_slider_value('DISTORTION_RAD_RAND_MAX', conf.DISTORTION_RAD_RAND_MAX)
    
    
    # --- assessment/constraints ---
    set_slider_value('EDGE_DISTANCE_MIN', conf.EDGE_DISTANCE_MIN)
    set_slider_value('CANTILEVER_MAX', conf.CANTILEVER_MAX)
    set_slider_value('CURVATURE_MIN', conf.CURVATURE_MIN)
    set_slider_value('COLUMN_LENGTH_MAX', conf.COLUMN_LENGTH_MAX)
# ---------- end set_config_values ----------
panel_5 = Panel(controller.val)
panel_6 = Panel(controller_2.val)
G = GhPythonScript(mode=panel_5, g_from_gen_mode=controller_2.val)  # -> out, g; inputs mode: Int32, g_from_gen_mode: Int32, g_from_regen_mode: Int32
# ---------- G: Python ----------
__author__ = "aapolina"
__version__ = "2020.06.24"

"""
Generare from scratch       = 0
Generate from ML prediction = 1
Generate from curves        = 2
"""

if mode == 0:
    g = g_from_gen_mode
elif mode == 1:
    g = g_from_regen_mode
else:
    g = -1
# ---------- end G ----------
generation = Panel(G.g)
int = Integer(generation)
# Data output
generation_2 = Panel(int)
seed = GhPythonScript(seed_option=list, g=int, s=manual_seed)  # -> rand_seed; inputs seed_option: Int32
# ---------- seed: Python ----------
import Rhino.Geometry as rg
import ghpythonlib.components as ghcomp

if   seed_option == 0: rand_seed = None
elif seed_option ==1:  rand_seed = g
elif seed_option ==2:  rand_seed = s
# ---------- end seed ----------
seed_2 = Integer(seed)
panel_7 = Panel(seed_2)
tag = TextTag3D(Location=PlaneXY(5.911438222, -5.683974617, 0), Text=generation, Size=1, Justification=7)

# ----
# Plot / Parcel / Building site
building_site_parcel_boundary = Curve(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)
explicit_input_grid_pts_inside_plot = Point(flatten([Point(-7.033519745, -4.332801967, 0), Point(-3.694818318, -4.975509348, 0), Point(-0.3561168902, -5.618216728, 0), Point(-4.807568113, -1.762755406, 0), Point(-1.468866685, -2.405462786, 0), Point(1.869834742, -3.048170167, 0), Point(-2.58161648, 0.8072911562, 0), Point(0.7570849474, 0.1645837756, 0), Point(-0.3556648476, 3.377337718, 0), Point(2.98303658, 2.734630337, 0), Point(1.870286785, 5.94738428, 0)]))

# ----
# Grid & Parcel
explicit_input_grid_pts_inside_plot_old = Point(flatten([Point(-0.3556648476, 3.377337718, 0), Point(-3.694818318, -4.975509348, 0), Point(-7.033519745, -4.332801967, 0), Point(-2.58161648, 0.8072911562, 0), Point(2.98303658, 2.734630337, 0), Point(1.870286785, 5.94738428, 0), Point(-4.807568113, -1.762755406, 0), Point(-1.468866685, -2.405462786, 0), Point(0.7570849474, 0.1645837756, 0), Point(1.869834742, -3.048170167, 0), Point(-0.3561168902, -5.618216728, 0)]))  # "EXPLICIT INPUT grid pts inside plot (OLD ORDER)"; disabled
# Geometry basics
# Manual inputs
saved_radii_charges = Number(Tree({0}: [1.839643719, 2.03752373, 2.358153924], {1}: [1.111969215, 1.034439227, 2.380104302], {2}: [2.360607008, 1.080233626, 2.193803812], {3}: [2.028507534, 1.82265783, 2.019007987, 1.899482414, 2.358706451], {4}: [1.646977753, 1.446428239, 2.395090198, 2.251791211, 1.890417199]))  # disabled
rain_occlusion = Slider(50, range=-0.1..100)

# ----
# Chalice z levels
button_2 = Button()
# Generate random inputs for SDF
n_chalices = Slider(5, range=2..15)
z_highest = Slider(19, range=6..24)
z_lowest = Slider(4.5, range=0..20)
z_dist_min = Slider(3, range=1.5..3)
z_distribution = ValueList({"equal": 0, "random": 1, "random with min. dist.": 2}, selected="equal")
z_levels = GhPythonScript(
    n=n_chalices,
    z_min=z_lowest,
    z_max=z_highest,
    d_min=z_dist_min,
    z_option=z_distribution,
    rand_seed=seed_2,
    refresh=button_2)  # -> out, z, d; inputs n: Int32, z_option: Int32, rand_seed: Int32
# ---------- z_levels: Python ----------
__author__ = "aapolina"
__version__ = "2020.03.26"

import Rhino.Geometry as rg
import random
import math

#refresh has an effect only if rand_seed = None
if rand_seed <> None: random.seed(rand_seed) 


if z_option == 0:
    #equal
    z = [z_min + (z_max-z_min)/(n-1)*i for i in range(n)]
elif z_option == 1:
    #random
    rz = [0.0]+[random.random() for i in range(n-2)]+[1.0]
    rz.sort()
    z = [z_min + i*(z_max-z_min) for i in rz ]
elif z_option == 2:
    #random with min dist
    rd = [random.random() for i in range(n-1)] #random distances
    x = (z_max-z_min-d_min*(n-1)) / sum(rd)
    d = [d_min + ri*x for ri in rd]
    z = [z_min] + [z_min + sum(d[:i+1]) for i in range(n-1)]

d = [z[i+1]-z[i] for i in range(n-1)]
# ---------- end z_levels ----------
levels = Panel(z_levels.z)
distances_between_levels = Panel(z_levels.d)
generated_z_levels = Number(z_levels.z)

# ----
# Requested design performace (X)
sun_occlusion = Slider(34.6, range=-0.1..100)
set_new_request = Button()
area_total_m2 = Slider(227.7, range=-0.1..300)
area_level_5_m2 = Slider(-0.1, range=-0.1..300)
area_level_4_m2 = Slider(-0.1, range=-0.1..300)
area_level_3_m2 = Slider(-0.1, range=-0.1..300)
area_level_2_m2 = Slider(-0.1, range=-0.1..300)
area_level_1_m2 = Slider(-0.1, range=-0.1..300)
swatch = ColourSwatch(SwatchColor=RGB(0, 174, 255))  # disabled
panel_8 = Panel(saved_radii_charges)  # disabled
num = Number([area_level_1_m2, area_level_2_m2, area_level_3_m2, area_level_4_m2, area_level_5_m2])
n_rays = Slider(30, range=3..64)
grid_pts = Point(explicit_input_grid_pts_inside_plot)
set_x = GhPythonScript(
    sun_occl=sun_occlusion,
    rain_occl=rain_occlusion,
    area_total=area_total_m2,
    area_levels=num,
    n_results="10",
    send=set_new_request)  # -> out, X; inputs area_levels: list, n_results: Int32
# ---------- set_x: Python ----------
__author__ = "aapolina"
__version__ = "2020.08.25"

import pickle
import os

filepath = ghenv.Component.OnPingDocument().FilePath
root_dir = os.path.dirname(os.path.dirname(os.path.dirname(os.path.realpath(filepath))))
output_dir = os.path.join(root_dir, "data/interface_learned_model/X")
#output_dir = r"C:\Users\aapolina\PROJECTS\research\Semiramis_SDSC_limited\data\interface_learned_model\X"


def val_or_unset(x):
    if x<0: return None
    else: return x

sun_occl = val_or_unset(sun_occl)
rain_occl = val_or_unset(rain_occl)
area_total = val_or_unset(area_total)
area_levels = [val_or_unset(x) for x in area_levels]


X = {
'occlusion_sun': sun_occl,
'occlusion_rain': rain_occl,
'surface_area_total': area_total,
'surface_areas': area_levels,
'outline_length_total': None,
'outline_lengths': [None, None, None, None, None],
'n_results': n_results,
}

output_file = 'x.pkl'
if send:
    with open(os.path.join(output_dir, output_file), 'wb') as f:
        pickle.dump(X,f)

#========================
X = [X]
# ---------- end set_x ----------
ghpython_script = GhPythonScript(grid_pts=grid_pts)  # -> out, cN; inputs grid_pts: list of Point3d
# ---------- ghpython_script: Python ----------
__author__ = "aapolina"
__version__ = "2020.08.20"

import rhinoscriptsyntax as rs
from compas.datastructures import Network as cNet 

cN = cNet()
for i,p in enumerate(grid_pts):
    attr ={'x':p.X, 'y': p.Y, 'z':p.Z}
    cN.add_node(i,attr)

edges = [
    (0,1),
    (0,3),
    (1,2),
    (1,3),
    (1,4),
    (2,4),
    (2,5),
    (3,4),
    (3,6),
    (4,5),
    (4,6),
    (4,7),
    (5,7),
    (6,7),
    (6,8),
    (7,8),
    (7,9),
    (8,9),
    (8,10),
    (9,10),
]

for e in edges:
    cN.add_edge(e[0],e[1])
# ---------- end ghpython_script ----------
set_slider = GhPythonScript(n="10", refresh=set_new_request)  # -> out; inputs n: Int32
# ---------- set_slider: Python ----------
__author__ = "aapolina"
__version__ = "2020.08.25"
import Grasshopper
doc = Grasshopper.Instances.ActiveCanvas.Document

def FindBatteryByNickname(docObjects, name):
    if docObjects is None: return None

    for obj in docObjects:
        attr = obj.Attributes

        if attr.PathName == name:
            return obj
    raise Exception(name + " was not found in document")


def set_slider_value(slider_name, val, vmin, vmax):
    bat = FindBatteryByNickname(doc.Objects, slider_name)
    bat.Slider.Value = val
    bat.ExpireSolution(True)
    bat.Slider.Minimum = vmin
    bat.Slider.Maximum = vmax

set_slider_value('result_Wi',0,0,n-1)
# ---------- end set_slider ----------
ghpython_script_2 = GhPythonScript(grid_pts=grid_pts)  # -> out, grid_pts_xy; inputs grid_pts: list of Point3d
# ---------- ghpython_script_2: Python ----------
grid_pts_xy = [ [ [p.X,p.Y] for p in grid_pts] ]
# ---------- end ghpython_script_2 ----------
ghpython_script_3 = GhPythonScript(grid_pts=grid_pts)  # -> out, grid_size; inputs grid_pts: list of Point3d
# ---------- ghpython_script_3: Python ----------
__author__ = "aapolina"
__version__ = "2020.07.24"

#find grid size from points (assuming regular grid)
grid_size = min([pi.DistanceTo(pj) for i,pi in enumerate(grid_pts[:-1]) for pj in grid_pts[i:]  if pi.DistanceTo(pj)>1e-4])
# ---------- end ghpython_script_3 ----------
points = PointList(Points=grid_pts, Size=1)
preview = CustomPreview(Geometry=[grid_pts, building_site_parcel_boundary], Material=ColourSwatch(SwatchColor=RGB(194, 194, 194)))  # disabled
z_levels_manual = Number([4.5, 7.5, 12, 15.5, 19])  # disabled
grid_size_m = Panel(ghpython_script_3.grid_size)
# Legend: n levels
# k grid points
# 
# grid_pts: [P0,Pi,...Pk]
# 	where:
# 	Pi = [xi,yi]
# 	grid points are fixed and need not be predicted
# 
# z_levels: [Z0,Zi,...,Zn]
# 
# sdf_radii: [L0,Li,...,Ln]
# 	where:
# 	Li = [ri0,rij,...,rik]
# 	if rij == 0: this grid point is outside of bowl
levels_2 = Panel(z_levels_manual)  # disabled
pack = GhPythonScript(x=generated_z_levels)  # -> out, one_list; inputs x: list
# ---------- pack: Python ----------
one_list = [ x ] #list per level
print len(one_list)
# ---------- end pack ----------
epsilon = Slider(0.005, range=0.001..1)
max_dist = Slider(30, range=0..200)
list_2 = ValueList({"No Smoothening": 1, "Exponential": 2, "Power": 3, "Blob": 4}, selected="Blob")
result_wi = Slider(0, range=0..9)
# Decoded geometries (W')
button_3 = Button()
get_w = GhPythonScript(read=set_new_request, try_again=Button(), clear=Button())  # -> out, W_all; inputs read: Boolean, try_again: Boolean
# ---------- get_w: Python ----------
__author__ = "aapolina"
__version__ = "2020.08.26"

import time, datetime
from datetime import datetime,timedelta
import random
import pickle
import os

import Grasshopper.Kernel.GH_ActiveObject as this_comp

filepath = ghenv.Component.OnPingDocument().FilePath
root_dir = os.path.dirname(os.path.dirname(os.path.dirname(os.path.realpath(filepath))))
input_dir = os.path.join(root_dir, "data/interface_learned_model/W")
#input_dir = r"C:\Users\aapolina\PROJECTS\research\Semiramis_SDSC_limited\data\interface_learned_model\W"
input_file = os.path.join(input_dir, 'w.pkl')


t0 = None


if read or try_again: 
    #print "new t0"
    W_all = None
    t0 = datetime.now()

timeout = 5.0 #sec

if t0: 
    no_data = True
    while no_data and datetime.now() < t0 + timedelta(seconds = timeout):
        if os.path.isfile(input_file):
            no_data = False
        else:
            time.sleep(0.25)
            #print datetime.now()

    if no_data: 
        print "timeout"
    else: 
        print "file found"
    #print datetime.now() - t0
    #print "----"

try:
    if not no_data:
        #read w.pkl (should contain a list of W as dictionaries)
        print "file %s found at "%input_file, datetime.now()
        with open(input_file,'rb') as f:
            W_all = pickle.load(f)
            #print W_all
except:
    pass

if clear: 
    t0 = None
    no_data = True
    W_all = None
# ---------- end get_w ----------
get_w_2 = GhPythonScript(read=button_3)  # -> out, W_all
# ---------- get_w_2: Python ----------
__author__ = "aapolina"
__version__ = "2020.08.25"

import rhinoscriptsyntax as rs

import pickle
import os

filepath = ghenv.Component.OnPingDocument().FilePath
root_dir = os.path.dirname(os.path.dirname(os.path.dirname(os.path.realpath(filepath))))
input_dir = os.path.join(root_dir, "data/interface_learned_model/W")



#read w.pkl (should contain a list of W as dictionaries)
input_file = os.path.join(input_dir, 'w.pkl')
with open(input_file,'rb') as f:
    W_all = pickle.load(f)




#dummy==========================================================================
W = {
'radii': [
[0, 0, 0, 2, 2, 0, 2, 2, 0, 2, 0], 
[0, 0, 0, 0, 0, 0, 0, 2, 2, 2, 0], 
[0, 2, 0, 0, 2, 2, 0, 2, 0, 0, 0], 
[2, 2, 2, 0, 2, 0, 0, 0, 0, 0, 0], 
[0, 0, 2, 0, 2, 0, 2, 2, 0, 2, 0]
],
'heights': [4.5,8,11,15,19]
}
W_all = [W]
# ---------- end get_w_2 ----------
externally_set_w = Data("Grasshopper.Kernel.Types.GH_ObjectWrapper")
panel_9 = Panel(get_w.out)
python = GhPythonScript(W=get_w.W_all, cN=ghpython_script.cN, i=result_wi)  # -> out, z_levels, pts_per_level, radii_per_level; inputs W: list, i: Int32
# ---------- python: Python ----------
__author__ = "aapolina"
__version__ = "2020.08.25"

import rhinoscriptsyntax as rs
import Rhino.Geometry as rg
from ghpythonlib.treehelpers import list_to_tree


W = W[i] #select design 
print W
z_levels = W['geo']['z_levels']
bools = W['geo']['sdf_radii']


indices = [[i for i in range(len(level)) if level[i]>0] for level in bools]
print indices

radii = [[level[i] for i in range(len(level)) if level[i]>0] for level in bools]
print radii


def list2rPt(a):
    return rg.Point3d(a[0], a[1], a[2])

def get_constellation_pts(cnet,vx,z=0.0):
    pts = []
    for vi in vx:
        p = list2rPt(cnet.node_coordinates(vi)[:-1]+[z])
        pts.append(p)
    return pts

pts_per_level = []

for z,ix in zip(z_levels,indices):
    pts_per_level.append(get_constellation_pts(cN, ix,z))


#========================================
pts_per_level = list_to_tree(pts_per_level)
radii_per_level = list_to_tree(radii)
# ---------- end python ----------
python_2 = GhPythonScript(W=externally_set_w, cN=ghpython_script.cN)  # -> out, z_levels, pts_per_level, radii_per_level
# ---------- python_2: Python ----------
__author__ = "aapolina"
__version__ = "2020.08.25"

import rhinoscriptsyntax as rs
import Rhino.Geometry as rg
from ghpythonlib.treehelpers import list_to_tree


W = W[0] #select design 
z_levels = W['geo']['z_levels']
bools = W['geo']['sdf_radii']


indices = [[i for i in range(len(level)) if level[i]>0] for level in bools]
print indices

radii = [[level[i] for i in range(len(level)) if level[i]>0] for level in bools]
print radii


def list2rPt(a):
    return rg.Point3d(a[0], a[1], a[2])

def get_constellation_pts(cnet,vx,z=0.0):
    pts = []
    for vi in vx:
        p = list2rPt(cnet.node_coordinates(vi)[:-1]+[z])
        pts.append(p)
    return pts

pts_per_level = []

for z,ix in zip(z_levels,indices):
    pts_per_level.append(get_constellation_pts(cN, ix,z))


#========================================
pts_per_level = list_to_tree(pts_per_level)
radii_per_level = list_to_tree(radii)
# ---------- end python_2 ----------
value_list = ValueList({"rebuild off": 0, "rebuild on": 1}, selected="rebuild off")
predicted_z_levels = Number(python_2.z_levels)
predicted_support_pts_per_level = Point(python_2.pts_per_level)
predicted_radii_charges = Number(python_2.radii_per_level)
predicted_z_levels_2 = Number(python.z_levels)
Z = StreamFilter(
    Gate=panel_5,
    Stream0=generated_z_levels,
    Stream1=predicted_z_levels_2,
    Stream2=z_levels_manual,
    Stream3=predicted_z_levels)
z_levels_2 = Number(Z)

# ----
# Sternenbilder
button_4 = Button()
constellations_explicit = GhPythonScript(cN=ghpython_script.cN, z_levels=z_levels_2, rand_seed=seed_2, refresh=button_4)  # -> out, picked_constellations, simplify(bools_per_level), simplify(pts_per_level), simplify(lines_per_level); inputs z_levels: list, rand_seed: Int32, refresh: Boolean
# ---------- constellations_explicit: Python ----------
__author__ = "aapolina"
__version__ = "2020.08.24"

from ghpythonlib.treehelpers import list_to_tree
import Rhino.Geometry as rg
import random
if rand_seed <> None: random.seed(rand_seed) 


preselected_constellations = [[0, 1, 3], [0, 1, 4], [0, 3, 4], [1, 2, 3], [1, 2, 4], [1, 2, 5], [1, 3, 4], [1, 3, 6], [1, 4, 5], [1, 4, 6], [2, 3, 4], [2, 4, 5], [2, 4, 7], [2, 5, 7], [3, 4, 6], [3, 4, 7], [3, 6, 7], [4, 5, 6], [4, 5, 7], [4, 6, 7], [4, 6, 8], [4, 7, 8], [5, 6, 7], [5, 7, 9], [6, 7, 8], [6, 7, 9], [6, 8, 9], [7, 8, 9], [7, 8, 10], [7, 9, 10], [8, 9, 10], [0, 1, 2, 3], [0, 1, 2, 4], [0, 1, 3, 4], [0, 1, 3, 6], [0, 3, 4, 6], [1, 2, 3, 4], [1, 2, 4, 5], [1, 2, 4, 6], [1, 2, 4, 7], [1, 3, 4, 5], [1, 3, 4, 
6], [1, 3, 4, 7], [1, 4, 5, 6], [1, 4, 5, 7], [1, 4, 6, 7], [2, 3, 4, 6], [2, 3, 4, 5], [2, 3, 4, 7], [2, 4, 5, 7], [2, 4, 5, 6], [2, 4, 6, 7], [3, 4, 5, 7], [3, 4, 
5, 6], [3, 4, 6, 8], [3, 4, 6, 7], [3, 6, 7, 8], [4, 5, 6, 7], [4, 5, 7, 8], [4, 5, 7, 9], [4, 6, 7, 9], [4, 6, 7, 8], [4, 7, 8, 9], [5, 6, 7, 9], [5, 6, 7, 8], [5, 
7, 8, 9], [6, 7, 8, 9], [6, 7, 8, 10], [6, 8, 9, 10], [7, 8, 9, 10], [0, 1, 2, 3, 4], [0, 1, 2, 3, 6], [0, 1, 2, 4, 5], [0, 1, 2, 4, 6], [0, 1, 2, 4, 7], [0, 1, 3, 4, 6], [0, 1, 3, 4, 5], [0, 1, 3, 4, 7], [0, 2, 3, 4, 6], [0, 3, 4, 6, 8], [0, 3, 4, 5, 6], [0, 3, 4, 6, 7], [1, 2, 3, 4, 5], [1, 2, 3, 4, 6], [1, 2, 3, 4, 7], [1, 2, 4, 5, 7], [1, 2, 4, 5, 6], [1, 2, 4, 6, 7], [1, 3, 4, 5, 7], [1, 3, 4, 5, 6], [1, 3, 4, 6, 7], [1, 3, 4, 6, 8], [1, 4, 5, 6, 7], [1, 4, 5, 7, 8], [1, 4, 5, 7, 9], [1, 4, 6, 7, 8], [1, 4, 6, 7, 9], [2, 3, 4, 6, 7], [2, 3, 4, 5, 6], [2, 3, 4, 5, 7], [2, 3, 4, 6, 8], [2, 4, 5, 6, 7], [2, 4, 5, 7, 8], [2, 4, 5, 7, 9], [2, 4, 6, 7, 
9], [2, 4, 6, 7, 8], [3, 4, 5, 6, 7], [3, 4, 5, 7, 8], [3, 4, 5, 7, 9], [3, 4, 5, 6, 8], [3, 4, 6, 7, 8], [3, 4, 6, 7, 9], [3, 5, 6, 7, 8], [3, 6, 7, 8, 9], [3, 6, 7, 8, 10], [4, 5, 6, 7, 9], [4, 5, 6, 7, 8], [4, 5, 7, 8, 9], [4, 6, 7, 8, 9], [4, 6, 7, 8, 10], [4, 7, 8, 9, 10], [5, 6, 7, 8, 9], [5, 6, 7, 8, 10], [5, 7, 8, 9, 10], [6, 7, 8, 9, 10]]

#all_A_shapes = [[0, 1, 2, 3, 6], [0, 1, 2, 4, 6], [0, 1, 2, 4, 7], [0, 2, 3, 4, 6], [0, 3, 4, 6, 8], [0, 3, 4, 5, 6], [1, 4, 5, 7, 8], [1, 4, 5, 7, 9], [1, 4, 6, 7, 9], [2, 3, 4, 6, 8], [2, 4, 6, 7, 9], [3, 4, 5, 7, 8], [3, 4, 5, 7, 9], [3, 4, 5, 6, 8], [3, 5, 6, 7, 8], [3, 6, 7, 8, 10], [5, 6, 7, 8, 10]]

#handpicked = all besize A and A_sombrero
handpicked_constellations = [[0, 1, 3], [1, 2, 4], [1, 3, 4], [2, 4, 5], [3, 4, 6], [4, 5, 7], [4, 6, 7], [6, 7, 8], [7, 8, 9], [8, 9, 10], [0, 1, 4], [0, 3, 4], [1, 2, 3], [1, 2, 5], [1, 3, 6], [1, 4, 5], [1, 4, 6], [2, 3, 4], [2, 4, 7], [2, 5, 7], [3, 4, 7], [3, 6, 7], [4, 5, 6], [4, 6, 8], [4, 7,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

def list2rPt(a):
    return rg.Point3d(a[0], a[1], a[2])

def get_constellation_lines(cnet, vx, z=0.0):
    lines = []
    edges = [e for e in cnet.edges() if e[0] in vx and e[1] in vx ]
    for e in edges:
        v1,v2 = e
        p1 = list2rPt(cnet.node_coordinates(v1)[:-1]+[z])
        p2 = list2rPt(cnet.node_coordinates(v2)[:-1]+[z])
        lines.append(rg.Line(p1,p2))
    return lines

def get_constellation_pts(cnet,vx,z=0.0):
    pts = []
    for vi in vx:
        p = list2rPt(cnet.node_coordinates(vi)[:-1]+[z])
        pts.append(p)
    return pts


allowed_constellations = handpicked_constellations

nn = len(list(cN.nodes()))
nc = len(allowed_constellations)
nz = len(z_levels)

ix = [random.choice(range(nc)) for _ in range(nz)]
picked_constellations = [allowed_constellations[i] for i in ix]


pts_per_level = []
lines_per_level = []
bools_per_level = []

for nodes,z in zip(picked_constellations,z_levels):
    pts = get_constellation_pts(cN, nodes, z)
    pts_per_level.append(pts)
    lines = get_constellation_lines(cN, nodes, z)
    lines_per_level.append(lines)
    bools = [int(i in nodes) for i in range(nn) ]
    bools_per_level.append(bools)

#===============================================================================
picked_constellations = [picked_constellations] #packed in one list for output
pts_per_level = list_to_tree(pts_per_level)
lines_per_level = list_to_tree(lines_per_level)
bools_per_level = list_to_tree(bools_per_level)
# ---------- end constellations_explicit ----------
output = Data(constellations_explicit.picked_constellations)
generated_support_pts_per_level = Point(constellations_explicit.pts_per_level)
preview_2 = CustomPreview(
    Geometry=[constellations_explicit.pts_per_level, constellations_explicit.lines_per_level],
    Material=ColourSwatch(SwatchColor=RGB(123, 93, 163)))  # disabled

# ----
# Random SDF radii / charges
min = Slider(1.2, range=0..5)
max = Slider(2.2, range=0..5)
radii = GhPythonScript(star_bools=constellations_explicit.bools_per_level, Rmin=min, Rmax=max, rand_seed=seed_2, refresh=button_4)  # -> out, simplify(randomR), simplify(randomR_bools); inputs star_bools: list of Int32, rand_seed: Int32
# ---------- radii: Python ----------
__author__ = "aapolina"
__version__ = "2020.07.08"

import rhinoscriptsyntax as rs
import random
import math

if rand_seed <> None: random.seed(rand_seed)

def map_to_sine(x):
    #map x values (0 to 1) to a sine-looking function y(a) with a in range(-pi/2,pi/2) and y moved and scale to range(0,1).
    #x = 0   -> a = -pi/2 
    #x = 0.5 -> a = 0
    #x = 1   -> a = pi/2
    #y = (sin(a)+1)/2 
    a = math.pi*(x-0.5) 
    return (math.sin(a)+1.0)*0.5

randoms = [map_to_sine(random.random()) for _ in star_bools]
randomR = [Rmin + r*(Rmax-Rmin) for b,r in zip(star_bools,randoms) if b==1]
randomR_bools = [b*(Rmin + r*(Rmax-Rmin)) for b,r in zip(star_bools,randoms)]

print randomR_bools
# ---------- end radii ----------
pack_2 = GhPythonScript(x=radii.randomR_bools)  # -> out, one_list; inputs x: tree
# ---------- pack_2: Python ----------
one_list = [ [list(branch) for branch in x.Branches] ] #list per level
print len(one_list)
# ---------- end pack_2 ----------
generated_radii_charges = Number(radii.randomR)

python_3 = GhPythonScript(
    grid_pts_xy=simplify(ghpython_script_2.grid_pts_xy),
    grid_indices=simplify(output),
    z_levels=simplify(pack.one_list),
    sdf_radii=simplify(pack_2.one_list))  # -> out, geometry_dict; inputs z_levels: list, sdf_radii: list
# ---------- python_3: Python ----------
geometry_dict = {
    #'grid_pts_xy': grid_pts_xy, #for some strange reason it already unpacks this list
    'grid_indices': grid_indices[0],
    'z_levels': z_levels[0],
    'sdf_radii': sdf_radii[0], #5 lists of 11 values (zeros if no radius)
    }

#print len(geometry_dict['sdf_radii'])

geometry_dict = [geometry_dict]
# ---------- end python_3 ----------
python_4 = GhPythonScript(z=z_levels.z, radii=pack_2.one_list)  # -> out, a; inputs z: list; disabled
# ---------- python_4: Python ----------
__author__ = "aapolina"
__version__ = "2020.08.25"

import rhinoscriptsyntax as rs


import pickle
import os

filepath = ghenv.Component.OnPingDocument().FilePath
root_dir = os.path.dirname(os.path.dirname(os.path.dirname(os.path.realpath(filepath))))
output_dir = os.path.join(root_dir, "data/interface_learned_model/W")


W = {
'heights': z,
'radii': radii,
}



output_file =  os.path.join(output_dir,'w.pkl')
with open(output_file,'wb') as f:
    pickle.dump([W],f)
# ---------- end python_4 ----------
predicted_support_pts_per_level_2 = Point(python.pts_per_level)
cpts = StreamFilter(
    Gate=panel_5,
    Stream0=generated_support_pts_per_level,
    Stream1=predicted_support_pts_per_level_2,
    Stream3=predicted_support_pts_per_level)
support_pts_per_level = Point(cpts)
# Generate Curves & Columns
support_pts_per_level_2 = Point(support_pts_per_level)

# ----
# columns
support_points_per_level = Point(support_pts_per_level)
columns = GhPythonScript(support_pts_at_levels=support_points_per_level)  # -> out, columns_count, columns_lines, columns_segments, support_pts_per_column; inputs support_pts_at_levels: tree of Point3d
# ---------- columns: Python ----------
__author__ = "aapolina"
__version__ = "2020.07.14"

import Rhino.Geometry as rg
from ghpythonlib.treehelpers import list_to_tree

spts = [list(branch) for branch in support_pts_at_levels.Branches] #list per level
spts_list = [p for level in spts for p in level] #flat list

#grid points on ground floor
gridpts = [(p.X,p.Y,0) for level in spts for p in level]
gridpts = set(gridpts)
gridpts = [rg.Point3d(x,y,z) for x,y,z in gridpts]

columns_count = len(gridpts)

#points grouped per column
tol =1e-4
spts_per_grid = [[gp]+[p for p in spts_list if gp.DistanceTo(rg.Point3d(p.X,p.Y,0))<tol] for gp in gridpts]
[col.sort(key = lambda p: p.Z) for col in spts_per_grid] #sort point in column

columns_lines = [rg.Line(pts[0], pts[-1]) for pts in spts_per_grid]
columns_segments = [[rg.Line(pts[i], pts[i+1]) for i in range(len(pts)-1)] for pts in spts_per_grid]


#-------------------------------------------
support_pts_per_column = list_to_tree(spts_per_grid)
columns_segments = list_to_tree(columns_segments)
# ---------- end columns ----------
n_columns = Integer(columns.columns_count)
column_lines = Curve(columns.columns_lines)
column_segments = Curve(columns.columns_segments)
pts = Point(columns.support_pts_per_column)

ghpython_script_4 = GhPythonScript(star_points=support_pts_per_level_2)  # -> out, ray_centre_pt; inputs star_points: list of Point3d
# ---------- ghpython_script_4: Python ----------
__author__ = "aapolina"
__version__ = "2020.07.08"

import rhinoscriptsyntax as rs
import Rhino.Geometry as rg

def average_pt(pts):
    n=len(pts)
    x = sum([p.X for p in pts])/n
    y = sum([p.Y for p in pts])/n
    z = sum([p.Z for p in pts])/n
    return rg.Point3d(x,y,z)

ray_centre_pt = average_pt(star_points)
# ---------- end ghpython_script_4 ----------
rays = GhPythonScript(cpt=ghpython_script_4.ray_centre_pt, n_rays=n_rays)  # -> out, simplify(ray_lines), simplify(ray_vecs); inputs cpt: Point3d, n_rays: Int32
# ---------- rays: Python ----------
__author__ = "aapolina"
__version__ = "2020.07.08"

import rhinoscriptsyntax as rs
import Rhino.Geometry as rg
import math

extend = 10 #[m]
n = n_rays
print [math.pi*2*i/float(n) for i in range(n)]

ray_vecs = [ rg.Vector3d(math.cos(alpha), math.sin(alpha), 0 ) for alpha in [math.pi*2*i/float(n) for i in range(n)]]

#scale and reverse direction
ray_vecs = [-v*extend for v in ray_vecs]

ray_lines = [rg.Line(cpt-v,v) for v in ray_vecs]
# ---------- end rays ----------
end = EndPoints(Curve=rays.ray_lines)  # -> Start, End
unit = UnitVector(Vector=rays.ray_vecs)
pt = Point(simplify(end.Start))
preview_3 = CustomPreview(Geometry=column_lines, Material=ColourSwatch(SwatchColor=RGB(0, 0, 0)))
vec = Vector(unit)
predicted_radii_charges_2 = Number(python.radii_per_level)
sdf_radii = StreamFilter(
    Gate=panel_5,
    Stream0=generated_radii_charges,
    Stream1=predicted_radii_charges_2,
    Stream2=saved_radii_charges,
    Stream3=predicted_radii_charges)
radii_charges = Number(sdf_radii)
sdf_radii_2 = Number(radii_charges)
cir = Circle(Plane=support_pts_per_level_2, Radius=sdf_radii_2)  # disabled
preview_4 = CustomPreview(Geometry=cir, Material=swatch)  # disabled
intrpol = GhPythonScript(pts=support_pts_per_level_2, radii=sdf_radii_2, div="3", gridsize=grid_size_m)  # -> out, lines, pts_extra, radii_extra, pts_all, radii_all; inputs pts: list of Point3d, radii: list, div: Int32
# ---------- intrpol: Python ----------
__author__ = "aapolina"
__version__ = "2020.08.21"

import Rhino.Geometry as rg


assert len(pts)==len(radii)

n = len(pts)
lines = []
tol=1e-4

idx = []

for i in range(n-1):
    for j in range(i+1,n):
        pi = pts[i]
        pj = pts[j]
        if abs(pi.DistanceTo(pj)-gridsize)<tol:
            lines.append(rg.Line(pi,pj))
            idx.append([i,j])

print idx

def interpolate(v1,v2,n,include_ends = False):
    #n = number of segments to divide the range
    #va = min([v1,v2])
    #vb = max([v1,v2])
    va=v1
    vb=v2
    d = vb-va
    s = float(d)/float(n)
    if include_ends:
        return [va+s*i for i in range(n+1)]
    else:
        return [va+s*i for i in range(1,n)]
    
    
pts_extra = []
radii_extra = []



for i,j in idx:
    pi = pts[i]
    pj = pts[j]
    pts_extra.extend( 
        [rg.Point3d(*xyz) for xyz in
        zip(interpolate(pi.X,pj.X,div,False), 
            interpolate(pi.Y,pj.Y,div,False), 
            interpolate(pi.Z,pj.Z,div,False))] )
    radii_extra.extend(interpolate(radii[i],radii[j],div,False))

pts_all = pts + pts_extra
radii_all = radii + radii_extra
# ---------- end intrpol ----------
sdf_centres = Point(simplify(intrpol.pts_all))
sdf_radii_3 = Number(simplify(intrpol.radii_all))
sdf_ray_tracing = GhPythonScript(
    ray_origins=pt,
    ray_directions=vec,
    centres=sdf_centres,
    radii=sdf_radii_3,
    smoothen=list_2,
    k_smoothness=Slider(3, range=0.001..10),
    stop_epsilon=epsilon,
    max_dist=max_dist)  # -> flatten(out), simplify(crvs_pts); inputs ray_origins: list of Point3d, ray_directions: list of Vector3d, centres: list of Point3d, radii: list
# ---------- sdf_ray_tracing: Python ----------
__author__ = "makohler"
__version__ = "2020.06.13"

import rhinoscriptsyntax as rs
import Rhino.Geometry as rg
import math
from ghpythonlib.treehelpers import list_to_tree

all_crv_pts = []
crvs = []


def dist2d(A,B):
    #euclideand distance between two 2D points
    return math.sqrt(sum([(ai-bi)**2 for ai,bi in zip(A,B)]))

def eval_sdf_no_smoothing(p,C=centres,R=radii):
    #smallest distance to any of the circles
    D = [dist2d(p,c)-r for c,r in zip(C,R)]
    dist = min(D)
    return dist

def eval_sdf_exponential(p,C=centres,R=radii,k=k_smoothness):
    dmin1=10000
    dmin2=100000
    for c,r in zip(C,R):
        d = dist2d(p,c)-r
        if d<dmin1:
            dmin2 = dmin1
            
    def exp_smooth_min(a,b,k):
        res = math.exp(-k*a) + math.exp(-k*b)
        print a,b, res, math.exp(-k*a), k, -k*a
        return -(math.log(res))/k
    
    dist = exp_smooth_min(dmin1,dmin2,k)
    
    return dist

def eval_sdf_power(p,C=centres,R=radii,k=k_smoothness):
    dmin1=10000
    dmin2=100000
    for c,r in zip(C,R):
        d = dist2d(p,c)-r
        if d<dmin1:
            dmin2 = dmin1
            dmin1 = d
            
    def power_smooth_min(a,b,k):
        ak = pow(a,k)
        bk = pow(b,k)
        return pow((ak*bk)/(ak+bk),1/k)
        
    dist = power_smooth_min(dmin1,dmin2,k)
    return dist

def eval_sdf_blob(p,C=centres,R=radii,k=k_smoothness):
    res=0
    for c,r in zip(C,R):
        d = dist2d(p,c)-r
        res += math.exp(-k*d)
    return -math.log(res)/k

#===============================================================================

for i, origin in enumerate(ray_origins):
    print "------------------",i
    direction = ray_directions[i]
    stop = False
    intersect = False
    point = origin
    step_nb = 0
    while not stop and step_nb<32:
        p = [point.X,point.Y]
        if   smoothen == 1: obj_dist = eval_sdf_no_smoothing(p)
        elif smoothen == 2: obj_dist = eval_sdf_exponential(p)
        elif smoothen == 3: obj_dist = eval_sdf_power(p)
        elif smoothen == 4: obj_dist = eval_sdf_blob(p)
        
        print obj_dist
        if point.DistanceTo(origin)> max_dist:
            stop = True
            #print('dist>max_dist')
        elif obj_dist < 0:
            stop = True
            print('Origin inside object !!')
        elif obj_dist < stop_epsilon:
            stop = True
            intersect = True
            print('Intersection')
            all_crv_pts.append(point)
            #print("Curve point added")
        else:
            point = point + obj_dist * direction
            step_nb = step_nb + 1

crvs_pts = all_crv_pts
# ---------- end sdf_ray_tracing ----------
pt_2 = Point(sdf_ray_tracing.crvs_pts)
intcrv = Interpolate(Vertices=pt_2, Degree=3, Periodic=True, KnotStyle=1)  # -> Curve, Length, Domain
reb = RebuildCurve(Curve=intcrv.Curve, Count=Slider(12, range=0..32), Tangents=True)  # disabled
filter = StreamFilter(Gate=value_list, Stream0=intcrv.Curve, Stream1=reb)
re_generated_top_curves = Curve(filter)
preview_5 = CustomPreview(Geometry=re_generated_top_curves, Material=ColourSwatch(SwatchColor=RGB(0, 79, 163)))

# ---- group: Sun simulation
# Sun rays
panel_10 = Panel("5")
range = Range(Domain="10 to 16", Steps="3")
range_2 = Range(Domain="1 to 6", Steps=panel_10)
X = UnitX(Factor=1)
Z_2 = UnitZ(Factor=1)
sun_angles = CSharpScript(
    GMT=Slider(2, range=0..23),
    Hour=range,
    DayOfMonth=Slider(21, range=0..31),
    Month=range_2,
    Year=Slider(2020, range=1970..2050),
    Latitude="41.9",
    Longitude="12.4833333",
    North=X,
    Up=Z_2,
    DataComparison="cross_reference")  # -> out, azimuth, altitude, direction; inputs GMT: Int32, Hour: Int32, DayOfMonth: Int32, Month: Int32, Year: Int32, Latitude: Double, Longitude: Double, North: Vector3d, Up: Vector3d
# ---------- sun_angles: C# ----------
    // Implementation in C# by Mikael Nillsson
    // http://guideving.blogspot.nl/2010/08/sun-position-in-c.html
    // Adaptation to Grasshopper By Arend van Waart <Arendvw@gmail.com>
    // @see http://stackoverflow.com/questions/8708048/position-of-the-sun-given-time-of-day-latitude-and-longitude

    North.Unitize();
    Up.Unitize();


    DateTime time = new DateTime(Year, Month, DayOfMonth, Hour, 0, 0, DateTimeKind.Utc);
    time = time.AddHours(-GMT);
    this.CalculateSunPosition(time, Latitude, Longitude);
    azimuth = this.azimuth;
    altitude = this.altitude;

    // plane: x = north; y = up
    Point3d p0 = new Point3d(0, 0, 0);
    Point3d p1 = new Point3d(1, 0, 0);
    p1.Transform(Transform.Translation(North));
    p1.Transform(Transform.Rotation(this.azimuth, Up, p0));

    Plane azPlane = new Plane(p0, new Vector3d(p1), Up);
    p1.Transform(Transform.Rotation(this.altitude, azPlane.ZAxis, p0));
    Vector3d dir = new Vector3d(p1);
    dir.Unitize();
    direction = dir;
# ---------- sun_angles: C# additional code ----------
  private const double Deg2Rad = Math.PI / 180.0;
  private const double Rad2Deg = 180.0 / Math.PI;
  private double altitude;
  private double azimuth;

    /*!
     * \brief Calculates the sun light.
     *
     * CalcSunPosition calculates the suns "position" based on a
     * given date and time in local time, latitude and longitude
     * expressed in decimal degrees. It is based on the method
     * found here:
     * http://www.astro.uio.no/~bgranslo/aares/calculate.html
     * The calculation is only satisfiably correct for dates in
     * the range March 1 1900 to February 28 2100.
     * \param dateTime Time and date in local time.
     * \param latitude Latitude expressed in decimal degrees.
     * \param longitude Longitude expressed in decimal degrees.
     */
  public void CalculateSunPosition(
    DateTime dateTime, double latitude, double longitude)
  {
    // Convert to UTC
    dateTime = dateTime.ToUniversalTime();

    // Number of days from J2000.0.
    double julianDate = 367 * dateTime.Year -
      (int) ((7.0 / 4.0) * (dateTime.Year +
      (int) ((dateTime.Month + 9.0) / 12.0))) +
      (int) ((275.0 * dateTime.Month) / 9.0) +
      dateTime.Day - 730531.5;

    double julianCenturies = julianDate / 36525.0;

    // Sidereal Time
    double siderealTimeHours = 6.6974 + 2400.0513 * julianCenturies;

    double siderealTimeUT = siderealTimeHours +
      (366.2422 / 365.2422) * (double) dateTime.TimeOfDay.TotalHours;

    double siderealTime = siderealTimeUT * 15 + longitude;

    // Refine to number of days (fractional) to specific time.
    julianDate += (double) dateTime.TimeOfDay.TotalHours / 24.0;
    julianCenturies = julianDate / 36525.0;

    // Solar Coordinates
    double meanLongitude = CorrectAngle(Deg2Rad *
      (280.466 + 36000.77 * julianCenturies));

    double meanAnomaly = CorrectAngle(Deg2Rad *
      (357.529 + 35999.05 * julianCenturies));

    double equationOfCenter = Deg2Rad * ((1.915 - 0.005 * julianCenturies) *
      Math.Sin(meanAnomaly) + 0.02 * Math.Sin(2 * meanAnomaly));

    double elipticalLongitude =
      CorrectAngle(meanLongitude + equationOfCenter);

    double obliquity = (23.439 - 0.013 * julianCenturies) * Deg2Rad;

    // Right Ascension
    double rightAscension = Math.Atan2(
      Math.Cos(obliquity) * Math.Sin(elipticalLongitude),
      Math.Cos(elipticalLongitude));

    double declination = Math.Asin(
      Math.Sin(rightAscension) * Math.Sin(obliquity));

    // Horizontal Coordinates
    double hourAngle = CorrectAngle(siderealTime * Deg2Rad) - rightAscension;

    if (hourAngle > Math.PI)
    {
      hourAngle -= 2 * Math.PI;
    }

    this.altitude = Math.Asin(Math.Sin(latitude * Deg2Rad) *
      Math.Sin(declination) + Math.Cos(latitude * Deg2Rad) *
      Math.Cos(declination) * Math.Cos(hourAngle));

    // Nominator and denominator for calculating Azimuth
    // angle. Needed to test which quadrant the angle is in.
    double aziNom = -Math.Sin(hourAngle);
    double aziDenom =
      Math.Tan(declination) * Math.Cos(latitude * Deg2Rad) -
      Math.Sin(latitude * Deg2Rad) * Math.Cos(hourAngle);

    this.azimuth = Math.Atan(aziNom / aziDenom);

    if (aziDenom < 0) // In 2nd or 3rd quadrant
    {
      this.azimuth += Math.PI;
    }
    else if (aziNom < 0) // In 4th quadrant
    {
      this.azimuth += 2 * Math.PI;
    }

    // Altitude
    //Console.WriteLine("Altitude: " + altitude * Rad2Deg);

    // Azimut
    //Console.WriteLine("Azimuth: " + azimuth * Rad2Deg);
  }

    /*!
    * \brief Corrects an angle.
    *
    * \param angleInRadians An angle expressed in radians.
    * \return An angle in the range 0 to 2*PI.
    */
  private static double CorrectAngle(double angleInRadians)
  {
    if (angleInRadians < 0)
    {
      return 2 * Math.PI - (Math.Abs(angleInRadians) % (2 * Math.PI));
    }
    else if (angleInRadians > 2 * Math.PI)
    {
      return angleInRadians % (2 * Math.PI);
    }
    else
    {
      return angleInRadians;
    }
  }
# ---------- end sun_angles ----------
rotate = Rotate(Geometry=sun_angles.direction, Angle=1.570796327, Plane=PlaneXY(0, 0, 0))  # -> Geometry, Transform
rev = Reverse(Vector=rotate.Geometry)
sun_viz = _sunViz(V=rev, num="10")  # -> L, S; disabled

# ----
# Columns
column_length_max = Slider(7.25, range=0..10)
number_of_columns = Panel(n_columns)
# Assess geometry
columns_segments = Curve(simplify(column_segments))
col_len = GhPythonScript(cN=ghpython_script.cN, bools_per_level=constellations_explicit.bools_per_level, z_levels=z_levels.z)  # -> out, column_segment_lenths_output, simplify(column_segment_lenths); inputs bools_per_level: tree of Int32, z_levels: list
# ---------- col_len: Python ----------
__author__ = "aapolina"
__version__ = "2020.08.28"

import Rhino.Geometry as rg
from ghpythonlib.treehelpers import list_to_tree

bools = [list(b) for b in bools_per_level.Branches]
assert len(z_levels)==len(bools)

def list2rPt(a):
    return rg.Point3d(a[0], a[1], a[2])

def get_constellation_pts(cnet,vx,z=0.0):
    pts = []
    for vi in vx:
        p = list2rPt(cnet.node_coordinates(vi)[:-1]+[z])
        pts.append(p)
    return pts


column_segment_lenths = []
for i in range(11):
    #11 grid points
    zs = [0,]
    
    for boo,z in zip(bools,z_levels):
        #iterating through levels
        if boo[i]:
            zs.append(z)
    
    if zs:
        dz = [zs[j+1]-zs[j] for j in range(len(zs)-1)]
        
    #fill = [None for _ in range(5-len(dz))]
    #dz.extend(fill)
    column_segment_lenths.append(dz)
    print dz

column_segment_lenths_output = [column_segment_lenths]

column_segment_lenths = list_to_tree(column_segment_lenths)
# ---------- end col_len ----------
columns_count = Integer(number_of_columns)
columns_stats = GhPythonScript(lines=flatten(columns_segments), max_length=column_length_max)  # -> out, total_length, average_length, shortest, longest, lengths_segments, exceeding_max_length, columns_length_ok; inputs lines: list of Line
# ---------- columns_stats: Python ----------
__author__ = "aapolina"
__version__ = "2020.03.27"

import rhinoscriptsyntax as rs

L = [l.Length for l in lines]
lengths_segments = L
total_length = sum(L)
average_length = sum(L)/len(L)

shortest = min(L)
longest = max(L)
exceeding_max_length = sum([1 for x in L if x>max_length])
# ---------- end columns_stats ----------
knicklängen = Data(col_len.column_segment_lenths_output)
panel_11 = Panel(columns_stats.exceeding_max_length)
shortest_m = Panel(columns_stats.shortest)
knicklängen_2 = Number(columns_stats.lengths_segments)
total_m = Panel(columns_stats.total_length)
av_m = Panel(columns_stats.average_length)
pack_3 = GhPythonScript(x=knicklängen_2)  # -> out, one_list; inputs x: tree; same code as pack_2
m = Panel(col_len.column_segment_lenths)  # disabled
longest_m = Panel(columns_stats.longest)

# ----
# Geometry 3D
# Chalice surfaces
top_curves = Curve(graft(re_generated_top_curves))
boundary = BoundarySurfaces(Edges=top_curves)  # -> simplify(Surfaces)
chalice_surface = Geometry(boundary)
preview_6 = CustomPreview(Geometry=chalice_surface, Material=ColourSwatch(SwatchColor=RGB(164, 222, 89)))

chalice_surface_2 = Geometry(flatten(chalice_surface))
ghpython_script_5 = GhPythonScript(S=chalice_surface_2, size=Slider(0.4, range=0.1..2))  # -> out, nU, nV; inputs S: Surface
# ---------- ghpython_script_5: Python ----------
__author__ = "aapolina"
__version__ = "2020.07.24"

import Rhino.Geometry as rg
import math

bb = S.GetBoundingBox(False)
dX = bb.Max.X - bb.Min.X
dY = bb.Max.Y - bb.Min.Y

nU = math.ceil(dX/size)
nV = math.ceil(dY/size)
# ---------- end ghpython_script_5 ----------
mesh_uv = MeshSurface(
    Surface=reparameterize(flatten(chalice_surface_2)),
    UCount=ghpython_script_5.nU,
    VCount=ghpython_script_5.nV,
    Overhang=True,
    Equalize=False)
demesh = DeconstructMesh(Mesh=mesh_uv)  # -> Vertices, Faces, Colours, Normals

column_radius = Slider(0.16, range=0..1)

# ----
# Chalices Visualisation
top_curves_2 = Geometry(flatten(re_generated_top_curves))
z_min = Slider(-1, range=-4..0)
z_max = Slider(-2, range=-4..0)
lng = ListLength(List=support_points_per_level)  # -> flatten(Length)
pln = Plane(top_curves_2)
ma = MassAddition(Input=lng)  # -> Result, PartialResults
dom = ConstructDomain(DomainStart=z_min, DomainEnd=z_max)
random = Random(Range=dom, Number=ma.Result, Seed=2)  # -> flatten(Random)
vec_2 = VectorXYZ(XComponent=0, YComponent=0, ZComponent=random)  # -> Vector, Length
divide = DivideCurve(Curve=top_curves_2, Count=32, Kinks=False)  # -> simplify(Points), Tangents, Parameters
move = Move(Geometry=flatten(support_points_per_level), Motion=vec_2.Vector)  # -> Geometry, Transform
facen = FaceNormals(Mesh=pln)  # -> Centers, Normals
pt_3 = Point(move.Geometry)
pt_4 = Point(divide.Points)
devec = DeconstructVector(Vector=facen.Centers)  # -> XComponent, YComponent, ZComponent
unflatten = UnflattenTree(Tree=pt_3, Guide=support_points_per_level)
subtraction = Subtraction(A=devec.ZComponent, B=0.02)
merge = Merge(Data1=simplify(unflatten), Data2=simplify(pt_4))
vec_3 = VectorXYZ(XComponent=0, YComponent=0, ZComponent=subtraction)  # -> Vector, Length
material = CreateMaterial(Diffuse=RGB(255, 210, 181), Specular=RGB(255, 255, 255), Emission=RGB(78, 80, 52), Transparency=0, Shine=0)
del = DelaunayMesh(Points=merge)
pln_2 = Plane(Plane(origin=(0, 0, 0), x=(0, 1, 0), y=(-1, 0, 0)))
move_2 = Move(Geometry=pln_2, Motion=vec_3.Vector)  # -> Geometry, Transform
msplit = MeshSplitPlane(Mesh=del, Plane=move_2.Geometry)  # -> Above, Below
unim = UnifyMesh(Mesh=msplit.Below)  # -> Result, Count
preview_7 = CustomPreview(Geometry=unim.Result, Material=ColourSwatch(SwatchColor=RGB(160, 150, 120)))

# ----
# Curve Projection
crv = Curve(flatten(re_generated_top_curves))
boundary_2 = BoundarySurfaces(Edges=crv)
lng_2 = ListLength(List=crv)
subtraction_2 = Subtraction(A=lng_2, B=1)
series = Series(Start=0, Step=1, Count=subtraction_2)
addition = Addition(A=series, B=1)
subtraction_3 = Subtraction(A=subtraction_2, B=series)
start_crv_idx = Integer(series)
series_2 = Series(Start=addition, Step=1, Count=subtraction_3)
item = ListItem(List=boundary_2, Index=start_crv_idx, Wrap=True)
intersect_crv_idx = Integer(series_2)
item_2 = ListItem(List=crv, Index=intersect_crv_idx, Wrap=True)
project = Project(Curve=item_2, Brep=item, Direction=Vector(0, 0, 1))

column_lines_2 = Curve(column_lines)
pipe = Pipe(Curve=column_lines_2, Radius=column_radius, Caps=1)
edges = BrepEdges(Brep=chalice_surface)  # -> Naked, Interior, NonManifold
preview_8 = CustomPreview(Geometry=pipe, Material=ColourSwatch(SwatchColor=RGB(160, 150, 120)))

# ----
# Rain occlusion
Z_3 = UnitZ(Factor=-1)
rain_vec = Vector(Z_3)
occ = Occlusion(Samples=simplify(demesh.Vertices), Obstructions=flatten(mesh_uv), Rays=rain_vec)  # -> simplify(Hits), flatten(Occlusion)
lng_3 = ListLength(List=rain_vec)
division = Division(A=occ.Hits, B=lng_3)
gradient = Gradient(LowerLimit=0, UpperLimit=1, Parameter=division, stops=[0: RGB(0, 166, 255), 1: RGB(218, 234, 240)])  # disabled
x100 = Number(expr("x*100", division))
avr = Average(Input=x100)
conmesh = ConstructMesh(Vertices=demesh.Vertices, Faces=demesh.Faces, Colours=gradient)  # disabled
avr_2 = Average(Input=flatten(avr))
preview_9 = CustomPreview(Geometry=conmesh, Material=ColourSwatch(SwatchColor=RGB(0, 162, 255)))  # disabled
rain_occlusion_per_level = Number(flatten(avr))
rain_occl = Panel(avr)  # disabled
rain_occl_total = Panel(avr_2)
rain_occlusion_total = Number(avr_2)
pack_4 = GhPythonScript(x=rain_occlusion_per_level)  # -> out, one_list; inputs x: tree; same code as pack_2

swatch_2 = ColourSwatch(SwatchColor=RGB(255, 71, 188))  # disabled
bake = BooleanToggle(False)
join = JoinCurves(Curves=edges.Naked, Preserve=False)  # -> simplify(Curves)

# ---- group: dummy
all_column_lengths_ok = Panel(columns_stats.columns_length_ok)
bool = Boolean(all_column_lengths_ok)

# ----
# Sun occlusion
sun_ray_vec = Vector(rev)
occ_2 = Occlusion(Samples=simplify(demesh.Vertices), Obstructions=flatten(mesh_uv), Rays=sun_ray_vec)  # -> simplify(Hits), flatten(Occlusion)
lng_4 = ListLength(List=sun_ray_vec)
division_2 = Division(A=occ_2.Hits, B=lng_4)
gradient_2 = Gradient(LowerLimit=0, UpperLimit=1, Parameter=division_2, stops=[0: RGB(255, 255, 255), 1: RGB(0, 0, 0)])  # disabled
x100_2 = Number(expr("x*100", division_2))
avr_3 = Average(Input=x100_2)
avr_4 = Average(Input=flatten(avr_3))
conmesh_2 = ConstructMesh(Vertices=demesh.Vertices, Faces=demesh.Faces, Colours=gradient_2)  # disabled
preview_10 = CustomPreview(Geometry=conmesh_2, Material=ColourSwatch(SwatchColor=RGB(255, 225, 0)))  # disabled
sun_occl = Panel(avr_3)  # disabled
sun_occlusion_per_level = Number(flatten(avr_3))
sun_occl_total = Panel(avr_4)
sun_occlusion_total = Number(avr_4)
pack_5 = GhPythonScript(x=sun_occlusion_per_level)  # -> out, one_list; inputs x: tree; same code as pack_2

merge_2 = Merge(Data1=chalice_surface, Data2=pipe, Data3=unim.Result, Data4=project)
dispatch = Dispatch(List=merge_2, DispatchPattern=bake)  # -> ListA, ListB

# ----
# Parcel fit
# still can't union multiple curves with holes
# WARNING! returns a false negative if design is narrow and wedgy
# adding a small extra offset
# so that no intersection with the border
# is detected where the region
# "touches" the border
surface_edge = Geometry(flatten(join))
top_curves_3 = Geometry(flatten(re_generated_top_curves))  # disabled
plot_boundary = Curve(flatten(building_site_parcel_boundary))
m_2 = Panel(".02")  # disabled
region = GhPythonScript(curves=surface_edge)  # -> out, regions; inputs curves: list of Curve
# ---------- region: Python ----------
__author__ = "aapolina"
__version__ = "2020.03.27"

import rhinoscriptsyntax as rs
import Rhino.Geometry as rg
from ghpythonlib.treehelpers import list_to_tree
import ghpythonlib as ghp


pln = rg.Plane.WorldXY
curves_at_floor = [rg.Curve.ProjectToPlane(c,pln) for c in curves]
regions = rg.Curve.CreateBooleanUnion(curves_at_floor)

"""
Goal: get only one curve as a boundary of the projected design
Reasons why there might be more then one regions:
    case 1: a "hole" = a small curve inside a larger one --> union
    case 2: really disjoint curves --> convex hull
"""

"""
if len(regions) == 1:
    #canonic situation, most of the time
    one_region = regions[0]

else:
    #try case 1: union (again) 
    regions2 = rg.Curve.CreateBooleanUnion(regions)
    if len(regions2) == 1:
        one_region = regions[0]
    else:
        #try case 2: sample boundary -> convex hull
        segmlength = 0.25 #[m]
        pts = [c.PointAt(t) for c in regions2 for t in c.DivideByLength(segmlength, True)]
        one_region = ghp.components.ConvexHull(pts)[1].ToNurbsCurve()


"""
# ---------- end region ----------
region_2 = Curve(region.regions)
cluster = Cluster(plot_boundary=plot_boundary, region_s=region_2, tolerance=m_2)  # -> plot_boundary_position_adjusted_2, region_position_adjusted_2; disabled
ghpython_script_6 = GhPythonScript(regions=region_2)  # -> out, one_region; inputs regions: list of Curve; disabled
# ---------- ghpython_script_6: Python ----------
__author__ = "aapolina"
__version__ = "2020.06.29"

import Rhino.Geometry as rg
import ghpythonlib as ghp

"""
Goal: get only one curve as a boundary of the projected design
Reasons why there might be more then one regions:
    case 1: a "hole" = a small curve inside a larger one --> union
    case 2: really disjoint curves --> convex hull
"""

if len(regions) == 1:
    #canonic situation, most of the time
    one_region = regions[0]
else:
    #try case 1: union (again) 
    regions2 = rg.Curve.CreateBooleanUnion(regions)
    if len(regions2) == 1:
        one_region = regions[0]
    else:
        #try case 2: sample boundary -> convex hull
        segmlength = 0.25 #[m]
        pts = [c.PointAt(t) for c in regions2 for t in c.DivideByLength(segmlength, True)]
        one_region = ghp.components.ConvexHull(pts)[1].ToNurbsCurve()
# ---------- end ghpython_script_6 ----------
plot_boundary_position_adjusted = Curve(cluster.plot_boundary_position_adjusted_2)  # disabled
region_position_adjusted = Curve(cluster.region_position_adjusted_2)  # disabled
ghpython_script_7 = GhPythonScript(region=region_2, plot_boundary=plot_boundary)  # -> out, is_outside; inputs region: Curve, plot_boundary: Curve
# ---------- ghpython_script_7: Python ----------
__author__ = "aapolina"
__version__ = "2020.06.29"

import Rhino.Geometry as rg
import ghpythonlib as ghp

"""
Checks if the design is not completely outside of the plot.
Important to check if there are no intersection between design region and the plot.
"""
pts = [region.PointAt(t) for t in region.DivideByCount(9, True)]
cpt = rg.Polyline(pts).CenterPoint()

print plot_boundary.Contains(cpt)  

if plot_boundary.Contains(cpt) in [rg.PointContainment.Outside, rg.PointContainment.Coincident]:
    is_outside = True
else:
    is_outside = False
# ---------- end ghpython_script_7 ----------
ccx = CurveCurve(CurveA=plot_boundary, CurveB=graft(region_2))  # -> flatten(Points), ParamsA, ParamsB
lng_5 = ListLength(List=ccx.Points)
pt_5 = Point(ccx.Points)
ghpython_script_8 = GhPythonScript(x=flatten(ghpython_script_7.is_outside))  # -> out, all_x; inputs x: list of Boolean
# ---------- ghpython_script_8: Python ----------
__author__ = "aapolina"
__version__ = "2020.06.12"

all_x = all(x)
# ---------- end ghpython_script_8 ----------
number_of_intersections = Panel(lng_5)
or = GateOr(A=number_of_intersections, B=ghpython_script_8.all_x)
bool_2 = Boolean(invert(or))
fits_on_parcel = Panel(bool_2)
bool_3 = Boolean(fits_on_parcel)

# ----
# Bleps
top_curves_4 = Geometry(re_generated_top_curves)
cx = CurveSelf(Curve=flatten(top_curves_4))  # -> Points, Params
lng_6 = ListLength(List=cx.Points)  # -> flatten(Length)
self_intersections = Panel(lng_6)
count_bleps = GhPythonScript(n_bleps=self_intersections)  # -> out, bleps_ok; inputs n_bleps: list of Int32
# ---------- count_bleps: Python ----------
__author__ = "aapolina"
__version__ = "2020.07.01"

if n_bleps:
    bleps_ok = sum(n_bleps) == 0
# ---------- end count_bleps ----------
bleps_ok_no_bleps = Panel(count_bleps.bleps_ok)
# !!!!
# There should be no bleps with SDF.
# But there are if ray marching.
bool_4 = Boolean(bleps_ok_no_bleps)

# ----
# Curve lengths & areas
# Curvature
top_curves_5 = Geometry(flatten(re_generated_top_curves))
area = GhPythonScript(C=flatten(top_curves_5))  # -> out, area_min, area_max, area_total, areas; inputs C: list of Curve
# ---------- area: Python ----------
__author__ = "aapolina"
__version__ = "2020.03.30"

import rhinoscriptsyntax as rs
import Rhino.Geometry as rg

areas = [rg.AreaMassProperties.Compute(c).Area for c in C]

r = 8
area_min = round(min(areas),r)
area_max = round(max(areas),r)
area_total = round(sum(areas),r)
areas = [round(a,r) for a in areas]
# ---------- end area ----------
outline_lentgh = GhPythonScript(C=flatten(top_curves_5))  # -> out, crv_min, crv_max, crv_total, crv_lengths; inputs C: list of Curve
# ---------- outline_lentgh: Python ----------
__author__ = "aapolina"
__version__ = "2020.03.30"

import rhinoscriptsyntax as rs
import Rhino.Geometry as rg

L = [c.GetLength() for c in C]

r = 8 
crv_min = round(min(L),r)
crv_max = round(max(L),r)
crv_total = round(sum(L),r)
crv_lengths = [round(a,r) for a in L]
# ---------- end outline_lentgh ----------
m2 = Panel(area.area_min)  # disabled
m2_2 = Panel(area.area_max)  # disabled
m2_3 = Panel(area.area_total)  # disabled
m2_4 = Panel(area.areas)  # disabled
m_3 = Panel(outline_lentgh.crv_total)  # disabled
m_4 = Panel(outline_lentgh.crv_lengths)  # disabled
m_5 = Panel(outline_lentgh.crv_min)  # disabled
m_6 = Panel(outline_lentgh.crv_max)  # disabled
num_2 = Number(outline_lentgh.crv_lengths)
num_3 = Number(area.area_total)
num_4 = Number(outline_lentgh.crv_total)
num_5 = Number(area.areas)
curvature_min = Slider(1.5, range=1..5)
top_curves_6 = Curve()
crv_2 = Curve(top_curves_6)
python_5 = GhPythonScript(crv=crv_2, r_outside=curvature_min, r_inside=curvature_min)  # -> out, min_outside, ok_outside, tco, pco, vco, port, min_inside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; inputs crv: Curve
# ---------- python_5: Python ----------
__author__ = "aapolina"
__version__ = "2020.06.17"

import rhinoscriptsyntax as rs

import Rhino.Geometry as rg
import copy


d0, d1 = crv.Domain
print d0,d1


mino = 1e5
pco = None
vco = None
tco = None
mini = 1e5
pci = None
vci = None
tci = None



n=100
for i in range(n):
    t = d0 + i*(d1-d0)/n
    v = crv.CurvatureAt(t)
    r = 1/(v.Length)
    
    #check inside/outside
    vu = copy.deepcopy(v)
    vu.Unitize()
    px = crv.PointAt(t)+vu*0.1
    x = crv.Contains(px)

    if x == rg.PointContainment.Outside and r<mino:
        mino = r
        pco = crv.PointAt(t)
        vco = v*r*r
        tco = t
        print "outside", t, r
    elif x == rg.PointContainment.Inside and r<mini:
        mini = r
        pci = crv.PointAt(t)
        vci = v*r*r
        tci = t
        print "inside", t, r

min_outside = mino
min_inside = mini

ok_outside = mino>r_outside
ok_inside = mini>r_inside
# ---------- end python_5 ----------
vdis = VectorDisplay(Anchor=python_5.pco, Vector=python_5.vco)
vdis_2 = VectorDisplay(Anchor=python_5.pci, Vector=python_5.vci)
and = GateAnd(A=python_5.ok_outside, B=python_5.ok_inside)
curvature = Curvature(Curve=crv_2, Parameter=python_5.tco)  # -> P, K, C
curvature_2 = Curvature(Curve=crv_2, Parameter=python_5.tci)  # -> P, K, C
curvatures_ok = Panel(and)
panel_12 = Panel(python_5.ok_outside)
panel_13 = Panel(python_5.ok_inside)
bool_5 = Boolean(curvatures_ok)

get_x = GhPythonScript(sun_occl=sun_occlusion_total, rain_occl=rain_occlusion_total, area_total=num_3, area_levels=num_5)  # -> out, X; inputs area_levels: list
# ---------- get_x: Python ----------
__author__ = "aapolina"
__version__ = "2020.08.25"


def val_or_unset(x):
    if x<0: return None
    else: return x

sun_occl = val_or_unset(sun_occl)
rain_occl = val_or_unset(rain_occl)
area_total = val_or_unset(area_total)
area_levels = [val_or_unset(x) for x in area_levels]


X = {
'occlusion_sun': sun_occl,
'occlusion_rain': rain_occl,
'surface_area_total': area_total,
'surface_areas': area_levels,
'outline_length_total': None,
'outline_lengths': [None, None, None, None, None],
}


#========================
X = [X]
# ---------- end get_x ----------
ghpython_script_9 = GhPythonScript(X_requested=set_x.X, X_achieved=get_x.X)  # -> out, report
# ---------- ghpython_script_9: Python ----------
__author__ = "aapolina"
__version__ = "2020.08.26"

import rhinoscriptsyntax as rs

keys = [
'occlusion_sun',
'occlusion_rain',
'surface_area_total',
'surface_areas',
]

assert all([k in X_requested.keys() for k in keys])
assert all([k in X_achieved.keys() for k in keys])

def val2str(x):
    if isinstance(x,float) or isinstance(x,int):
        return "%.1f"%x
    else:
        return "*"

print val2str(0)

report = "{0:<20}{1:>10}{2:>10}\n".format('','X  ',"X' ")
for k in keys:
    x0 = val2str(X_requested[k])
    x1 = val2str(X_achieved[k])
    #report+= "%s: X=%s \t X'=%s \n"%(k, x0, x1)
    report+= '{0:<20}{1:>10}{2:>10}\n'.format(k,x0,x1)
# ---------- end ghpython_script_9 ----------
comparison_x_and_x = Panel(ghpython_script_9.report)

# ----
# Check min. 3 non-colinear supports per chalice
# (guaranteed in generator mode,
# but needs to be checked in predictor mode)
# Check if each chalice has min. two and not too many supports.
# (guatanteed by design in generator, need to check in predictor mode)
# Check if all supports within one chalice are no more than 1 grid unit length apart
max_number_of_support_points_per_chalice = Panel("5")  # disabled
support_points_at_level = Point(support_points_per_level)  # disabled
support_points_at_level_2 = Point(support_points_per_level)  # disabled
support_points_at_level_3 = Point(support_points_per_level)  # disabled
support_count = GhPythonScript(P=simplify(support_points_at_level_2), max_supports_count=max_number_of_support_points_per_chalice)  # -> out, hulls, flatten(supports_count_ok); inputs P: list of Point3d; disabled
# ---------- support_count: Python ----------
__author__ = "aapolina"
__version__ = "2020.06.12"

pts = P


if len(pts)<3 or len(pts)>max_supports_count:
    supports_count_ok = False
else:
    supports_count_ok = True
# ---------- end support_count ----------
python_6 = GhPythonScript(P=support_points_at_level, grid_size=grid_size_m)  # -> out, supports_spacing_ok; inputs P: list of Point3d; disabled
# ---------- python_6: Python ----------
__author__ = "aapolina"
__version__ = "2020.07.24"


n=len(P)
tol = 1e-3

supports_spacing_ok = True

for i in range(n-1):
    #print [P[i].DistanceTo(P[j]) for j in range(n) if i<>j]
    d = min([P[i].DistanceTo(P[j]) for j in range(n) if i<>j])
    #print d
    if abs(d-tol)>grid_size:
        supports_spacing_ok=False
# ---------- end python_6 ----------
stability = GhPythonScript(P=simplify(support_points_at_level_3))  # -> out, hulls, flatten(supports_ok); inputs P: list of Point3d; disabled
# ---------- stability: Python ----------
__author__ = "aapolina"
__version__ = "2020.06.12"

import ghpythonlib as ghp
import Rhino.Geometry as rg

pts = P

tol = 1e-3

supports_ok = None

if len(pts)<3:
    supports_ok = False
else:
    try: 
        hull = ghp.components.ConvexHull(pts)[1].ToNurbsCurve()
        area = rg.AreaMassProperties.Compute(hull).Area
        if area > tol: 
            supports_ok = True
        else: 
            #area nearly zero --> supports co-linear
            #probably never occurs because no hull or not mass-area calculated
            supports_ok = False
    except:
        supports_ok = False
# ---------- end stability ----------
min_3_non_colinear_supports = Panel(stability.supports_ok)  # disabled
panel_14 = Panel(python_6.supports_spacing_ok)  # disabled
min_3_non_colinear_supports_2 = Panel(support_count.supports_count_ok)  # disabled
ghpython_script_10 = GhPythonScript(x=flatten(min_3_non_colinear_supports))  # -> out, all_x; inputs x: list of Boolean; disabled; same code as ghpython_script_8
stability_ok = Panel(ghpython_script_10.all_x)  # disabled
ghpython_script_11 = GhPythonScript(x=flatten(panel_14))  # -> out, all_x; inputs x: list of Boolean; disabled; same code as ghpython_script_8
supports_spacing_ok = Panel(ghpython_script_11.all_x)  # disabled
ghpython_script_12 = GhPythonScript(x=flatten(min_3_non_colinear_supports_2))  # -> out, all_x; inputs x: list of Boolean; disabled; same code as ghpython_script_8
number_of_supports_ok = Panel(ghpython_script_12.all_x)  # disabled
bool_6 = Boolean(stability_ok)  # disabled
bool_7 = Boolean(supports_spacing_ok)  # disabled
bool_8 = Boolean(number_of_supports_ok)  # disabled

# ----
# Columns to Outlines
cantilever_max = Slider(2.5, range=0..5)  # disabled
support_points_at_level_4 = Point(support_points_per_level)  # disabled
edge_distance_min = Slider(0.8, range=0..1)
top_curves_7 = Geometry(re_generated_top_curves)  # disabled
cantilever_max_2 = Slider(2.5, range=0..5)
support_points_at_level_5 = Point(support_points_per_level)
top_curves_8 = Geometry(flatten(re_generated_top_curves))
crv_3 = Curve(reparameterize(simplify(top_curves_7)))  # disabled
top_curves_9 = Geometry(re_generated_top_curves)
support_points_at_level_6 = Point(support_points_per_level)
pt_6 = Point(simplify(support_points_at_level_4))  # disabled
cantilever_pts = GhPythonScript(c=crv_3, pts=pt_6, cantilever_max=cantilever_max)  # -> out, cantilevers, cantilever_largest, cantilever_ok, visualize; inputs c: Curve, pts: list of Point3d; disabled
# ---------- cantilever_pts: Python ----------
__author__ = "aapolina"
__version__ = "2020.03.27"

import Rhino.Geometry as rg
import ghpythonlib as ghp




cantilever_largest = 0.0
visualize = None

divc = 50
cpts = [c.PointAt(t) for t in c.DivideByCount(divc,True)]

for pc in cpts:
    dx = 1e10
    closest_support = None
    for ps in pts:
        d = pc.DistanceTo(ps)
        if d<dx: 
            closest_support = ps
            dx = d
        
    if dx > cantilever_largest: 
        cantilever_largest = dx
        visualize = rg.Line(pc,closest_support)

 


cantilever_ok = (cantilever_largest<=cantilever_max)
# ---------- end cantilever_pts ----------
cantilever_hull = GhPythonScript(curves=flatten(top_curves_8), support_pts=support_points_at_level_5, cantilever_max=cantilever_max_2)  # -> out, cantilevers, cantilever_largest, cantilever_ok, vizualize, hulls; inputs curves: list of Curve, support_pts: tree of Point3d
# ---------- cantilever_hull: Python ----------
__author__ = "aapolina"
__version__ = "2020.03.27"

import Rhino.Geometry as rg
import ghpythonlib as ghp


"""
curves: chalice edge curves at levels
support_pts: per curve, at levels
"""
assert len(curves) == support_pts.BranchCount 
n = len(curves)
spts = [list(branch) for branch in support_pts.Branches]

cantilevers = []
vizualize = []

hulls = []
for pts in spts:
    if len(pts)>1: 
        h = ghp.components.ConvexHull(pts)[1].ToNurbsCurve() 
    else:
        h = pts[0]
    hulls.append(h)


divc = 50

for c,h in zip(curves,hulls):
    
    cpts = [c.PointAt(t) for t in c.DivideByCount(divc,True)]
    
    if isinstance(h, rg.Point3d):
        hpts = [h for _ in cpts]
        d = [cp.DistanceTo(h) for cp in cpts]
        
    else:
        hpts = [h.PointAt(h.ClosestPoint(p)[1]) for p in cpts]
        d = [cp.DistanceTo(hp) for cp,hp in zip(cpts,hpts)]
    #vizualize.extend([rg.Line(cp,hp) for cp,hp in zip(cpts,hpts)])
    
    chd = zip(cpts,hpts,d)
    chd.sort(key = lambda x: -x[2])

    
    cantilevers.append(chd[0][2])
    vizualize.append(rg.Line(chd[0][0], chd[0][1]))
 
cantilever_largest = max(cantilevers)
if cantilever_largest  <= cantilever_max:
    cantilever_ok  = True
else:
    cantilever_ok  = False
# ---------- end cantilever_hull ----------
dist_edge_to_internal_column = GhPythonScript(curve=top_curves_9, pts=support_points_at_level_6, min_edge_dist=edge_distance_min)  # -> out, flatten(edge_distances_ok); inputs curve: Curve, pts: list of Point3d
# ---------- dist_edge_to_internal_column: Python ----------
__author__ = "aapolina"
__version__ = "2020.03.27"

import Rhino.Geometry as rg


x = []
for p in pts:
    d = curve.PointAt(curve.ClosestPoint(p)[1]).DistanceTo(p)
    if d<min_edge_dist:
        x.append(d)

if not x: 
    edge_distances_ok = True
else: 
    edge_distances_ok = False
    print '%s: %s'%(len(x),['%.2f'%i for i in x])
# ---------- end dist_edge_to_internal_column ----------
swatch_3 = ColourSwatch(SwatchColor=RGB(0, 255, 213))  # disabled
m_7 = Panel(cantilever_pts.cantilever_largest)  # disabled
panel_15 = Panel(cantilever_pts.cantilever_ok)  # disabled
m_8 = Panel(cantilever_hull.cantilevers)
ghpython_script_13 = GhPythonScript(x=flatten(dist_edge_to_internal_column.edge_distances_ok))  # -> out, all_x; inputs x: list of Boolean; same code as ghpython_script_8
edge_distances_ok = Panel(ghpython_script_13.all_x)
m_9 = Panel(cantilever_hull.cantilever_largest)
cantilevers_ok = Panel(cantilever_hull.cantilever_ok)
preview_11 = CustomPreview(Geometry=cantilever_hull.vizualize, Material=ColourSwatch(SwatchColor=RGB(0, 161, 129)))
n_supports_too_close_to_edge = Panel(dist_edge_to_internal_column.out)
preview_12 = CustomPreview(Geometry=cantilever_hull.hulls, Material=ColourSwatch(SwatchColor=RGB(10, 255, 214)))
ghpython_script_14 = GhPythonScript(x=flatten(panel_15))  # -> out, all_x; inputs x: list of Boolean; disabled; same code as ghpython_script_8
ghpython_script_15 = GhPythonScript(x=flatten(m_7))  # -> out, max_x; inputs x: list; disabled
# ---------- ghpython_script_15: Python ----------
__author__ = "aapolina"
__version__ = "2020.06.12"

max_x = round(max(x),2)
# ---------- end ghpython_script_15 ----------
bool_9 = Boolean(edge_distances_ok)
cantilevers_all_ok = Panel(ghpython_script_14.all_x)  # disabled
cantilever_max_3 = Panel(ghpython_script_15.max_x)  # disabled
num_6 = Number(m_9)
bool_10 = Boolean(cantilevers_ok)

# ----
# Summary
design_performance_attributes = GhPythonScript(
    generation=int,
    surface_area_total=num_3,
    surface_areas=num_5,
    outline_length_total=num_4,
    outline_lengths=num_2,
    occlusion_sun=sun_occlusion_total,
    occlusion_sun_levels=pack_5.one_list,
    occlusion_rain=rain_occlusion_total,
    occlusion_rain_levels=pack_4.one_list,
    stability_ok=stability_ok,
    supports_count_ok=number_of_supports_ok,
    supports_spacing_ok=bool_7,
    columns_count=columns_count,
    columns_length_ok=bool,
    columns_longest=longest_m,
    columns_bending_lengths=knicklängen,
    cantilever_ok=bool_10,
    cantilever_largest=num_6,
    parcel_fit_ok=bool_3,
    curvatures_ok=bool_5,
    bleps_ok=bool_4,
    edge_distance_ok=bool_9)  # -> out, txt, dict_all, output_keys, dict_output, design_ok; inputs generation: Int32, surface_areas: list, outline_lengths: list, stability_ok: Boolean, supports_count_ok: Boolean, supports_spacing_ok: Boolean, columns_count: Int32, columns_length_ok: Boolean, cantilever_ok: Boolean, parcel_fit_ok: Boolean, curvatures_ok: Boolean, bleps_ok: Boolean, edge_distance_ok: Boolean
# ---------- design_performance_attributes: Python ----------
# --- COLLATE ALL ATTRIBUTES INTO ONE DICT -------------------------------------

dict = {}
dict['generation']=generation

# --- basic geometry characteristics ---
dict['surface_area_total']=surface_area_total
dict['surface_areas']=surface_areas
dict['outline_length_total']=outline_length_total
dict['outline_lengths']=outline_lengths

# --- main performance quantities ---
dict['occlusion_sun']=occlusion_sun
dict['occlusion_rain']=occlusion_rain
dict['occlusion_sun_levels']=occlusion_sun_levels
dict['occlusion_rain_levels']=occlusion_rain_levels

# --- other quantities ---
dict['columns_count']=columns_count
dict['columns_longest']=columns_longest
dict['columns_bending_lengths']=columns_bending_lengths
dict['cantilever_largest']=cantilever_largest

# --- buildability checks ---
dict['stability_ok']=stability_ok
dict['supports_count_ok']=supports_count_ok
dict['supports_spacing_ok']=supports_spacing_ok
dict['columns_length_ok']=columns_length_ok
dict['cantilever_ok']=cantilever_ok
dict['parcel_fit_ok']=parcel_fit_ok
dict['curvatures_ok']=curvatures_ok
dict['bleps_ok']=bleps_ok
dict['edge_distance_ok']=edge_distance_ok



# --- IS DESIGN VALID? ---------------------------------------------------------
# select which labels are taken into account to assess if design is valid/ok:
design_valid_keys = [
    'columns_length_ok',
    'parcel_fit_ok',
    'cantilever_ok',
    'edge_distance_ok',
    ]

design_ok_values = [x for x in [dict[k] for k in design_valid_keys] if x in [True,False]] #removes any "None" values
design_ok = all(design_ok_values) #ok if all True


dict['design_ok'] = design_ok 

# --- SELECT WHICH LABELS TO OUTPUT --------------------------------------------
output_keys = [
    'surface_area_total',
    'surface_areas',
    'outline_length_total',
    'outline_lengths',
    
    'occlusion_sun',
    'occlusion_sun_levels',
    'occlusion_rain',
    'occlusion_rain_levels',

    'columns_count',
    'columns_bending_lengths',
    'cantilever_largest',

    'parcel_fit_ok',
    'cantilever_ok',
    'edge_distance_ok',
    'design_ok',
    'bleps_ok',

    ]

#output_keys = dict.keys()
output_keys.sort()



#-------------------------------------------------------------------------------
txt=""
for k in dict.keys():
    txt+="{}: {}\n".format(k,dict[k])
dict_all = [dict] #need to "hide" the dictionary into a list to parse it between components
dict_output = [{k: dict[k] for k in output_keys}]
# ---------- end design_performance_attributes ----------
data_output = GhPythonScript(
    g=generation_2,
    mode=panel_5,
    include_invalid=include_invalid,
    geometry=python_3.geometry_dict,
    labels=design_performance_attributes.dict_output)  # -> out, output_data; inputs g: Int32, mode: Int32, include_invalid: Boolean, geometry: list, labels: list
# ---------- data_output: Python ----------
if True:
    labels = labels[0] #unpack dict from list

    design_is_valid =  labels['design_ok']

    if design_is_valid or include_invalid:
        
        #write geometry data as selected
        if mode == 1:
            # do not output geometry in "regenerate from ML" mode (1) or in "generate from curves" mode (2)
            geo = None
        else:
            geo = geometry[0] #unpack dict from list
        
        if mode == 2: info = {'generation': -1,}
        else:         info = {'generation':g,}

        output_data = [{'info':info, 'geo': geo, 'labels':labels}]
        
    else:
        print "invalid"
# ---------- end data_output ----------
design_ok = Panel(design_performance_attributes.design_ok)
tag_2 = TextTag3D(Location=PlaneXY(9, 5, 0), Text=design_performance_attributes.txt, Size=0.5, Colour=RGB(0, 0, 0), Justification=7)
output_all_data = Data(flatten(data_output.output_data))
panel_16 = Panel(design_performance_attributes.output_keys)  # disabled
panel_17 = Panel(output_all_data)  # disabled
cir_2 = Circle(Plane=pt_6, Radius=cantilever_max)
col = Colour([swatch_2, swatch_3])  # disabled
item_3 = ListItem(List=col, Index=panel_15, Wrap=True)  # disabled

preview_13 = CustomPreview(Geometry=cantilever_pts.visualize, Material=item_3)  # disabled

# ==== cluster _sunViz
V = ClusterInput()
num = ClusterInput()
num_2 = Number(num)
pt = ConstructPoint(XCoordinate=0, YCoordinate=0, ZCoordinate=0)
amp = Amplitude(Vector=V, Amplitude=num_2)
move = Move(Geometry=pt, Motion=amp)  # -> Geometry, Transform
division = Division(A=num_2, B="40")
sph = Sphere(Base=move.Geometry, Radius=division)
ln = Line(StartPoint=pt, EndPoint=move.Geometry)
L = ClusterOutput(ln)
S = ClusterOutput(sph)

# ==== cluster Cluster
tolerance = ClusterInput()
region_s = ClusterInput()
plot_boundary = ClusterInput()
tolerance_2 = Number(tolerance)
region_s_2 = Curve(flatten(region_s))
plot_boundary_2 = Curve(flatten(plot_boundary))
explode = Explode(Curve=plot_boundary_2, Recursive=True)  # -> Segments, Vertices
line = Line(explode.Segments)
python = GhPythonScript(lines=line)  # -> out, plns, lines; inputs lines: list of Line
# ---------- python: Python ----------
import Rhino.Geometry as rg

lines.sort(key = lambda l: l.Length)
lines = lines[2:]

plns = [rg.Plane(line.PointAt(0.5), line.UnitTangent, rg.Vector3d.CrossProduct(line.UnitTangent,rg.Vector3d(0,0,1))) for line in lines ]
# ---------- end python ----------
bbox = BoundingBox(Content=flatten(region_s_2), Plane=graft(python.plns), UnionBox=True)  # -> simplify(Box), simplify(Box_2)
data = Data(bbox.Box)
points = PointList(Points=python.plns, Size=1)
deplane = DeconstructPlane(Plane=python.plns)  # -> Origin, XAxis, YAxis, ZAxis
debox = DeconstructBox(Box=bbox.Box_2)  # -> Plane, X, Y, Z
dedomain = DeconstructDomain(Domain=debox.Y)  # -> Start, End
addition = Addition(A=dedomain.End, B=tolerance_2)
amp = Amplitude(Vector=flatten(deplane.YAxis), Amplitude=flatten(addition))
vdis = VectorDisplay(Anchor=deplane.Origin, Vector=amp)
dispatch = Dispatch(List=python.lines, DispatchPattern=[True, False])  # -> ListA, ListB
dispatch_2 = Dispatch(List=amp, DispatchPattern=[True, False])  # -> ListA, ListB
move = Move(Geometry=dispatch.ListB, Motion=dispatch_2.ListB)  # -> Geometry, Transform
move_2 = Move(Geometry=dispatch.ListA, Motion=dispatch_2.ListA)  # -> Geometry, Transform
llx = LineLine(Line1=dispatch.ListA, Line2=dispatch.ListB)  # -> ParamA, ParamB, PointA, PointB
llx_2 = LineLine(Line1=move_2.Geometry, Line2=move.Geometry)  # -> ParamA, ParamB, PointA, PointB
vec2pt = Vector2Pt(PointA=llx_2.PointA, PointB=llx.PointA, Unitize=False)  # -> Vector, Length
vdis_2 = VectorDisplay(Anchor=llx_2.PointA, Vector=vec2pt.Vector)
rev = Reverse(Vector=vec2pt.Vector)
move_3 = Move(Geometry=region_s_2, Motion=vec2pt.Vector)  # -> Geometry, Transform
move_4 = Move(Geometry=plot_boundary_2, Motion=rev)  # -> Geometry, Transform
plot_boundary_position_adjusted = Curve(move_4.Geometry)
region_position_adjusted = Curve(move_3.Geometry)
region_position_adjusted_2 = ClusterOutput(region_position_adjusted)
plot_boundary_position_adjusted_2 = ClusterOutput(plot_boundary_position_adjusted)
